# Grasshopper definition ACADIA_fabrication.gh (Grasshopper 1.0.7)

# INPUT GEOMETRY
crv = Curve([<curve referenced from the Rhino model> x45])

# ---- group: members
number_slider = Slider(15, range=0..44)
python = GhPythonScript(n=number_slider)  # -> rob_num; inputs n: Int32
# ---------- python: Python ----------
#Robot Order

order = [
2, #0
1, #1
2, #2
1, #3
2, #4
1, #5
2, #6
1, #7
2, #8
2, #9
1, #10
2, #11
2, #12
1, #13
2, #14
2, #15
1, #16
1, #17
2, #18
1, #19
2, #20
1, #21
2, #22
2, #23
2, #24
1, #25
2, #26
1, #27
2, #29
2, #28
1, #30
2, #31
1, #32
1, #33
1, #34
2, #33
2, #38
1, #36
1, #37
#done
2, #36
2, #37
2, #39
2, #41
2, #42
1, #43
]

rob_num = order[n]
# ---------- end python ----------
python_2 = GhPythonScript(n=number_slider)  # -> idx; inputs n: Int32
# ---------- python_2: Python ----------
idx = range(n+1)

print idx
# ---------- end python_2 ----------
panel = Panel(number_slider)
panel_2 = Panel(python)
data = Data(crv)
data_2 = Data(python_2)

# ---- group: nodes
pt = Point([<point referenced from the Rhino model> x17])
python_3 = GhPythonScript(n=number_slider)  # -> idx; inputs n: Int32
# ---------- python_3: Python ----------
sphere_order = {
0: 2,
1: 3,
2: 4,
3: 4,
4: 4,
5: 4,
6: 5,
7: 5,
8: 5,
9: 6,
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}

idx = range(sphere_order[n])

print idx
# ---------- end python_3 ----------
data_3 = Data(pt)
data_4 = Data(python_3)

# ----
panel_3 = Panel("C:/Users/Edvard/Documents/GitHub/workshop_princeton_2021/ACADIA/input_data/")  # disabled
toggle = BooleanToggle(True)  # disabled
panel_4 = Panel(data_4)

# ---- group: current member curves
data_5 = Data(data_2)
data_6 = Data(data)
item = ListItem(List=data_6, Index=data_5, Wrap=True)
crv_2 = Curve(item)

# ----
# GEOMETRIC INFO FOR FABRICATION
panel_5 = Panel(panel)

# ----
# ROBOT CONNECT
panel_6 = Panel("ros-79hh-s4fg.yaler.io")

ros = ROSConnect(connect=Toggle(True))  # -> ros_client, is_connected; inputs port: Int32, connect: Boolean
#   port ip: The ip address ROS. Defaults to 127.0.0.1.
#   port port: The port of ROS. Defaults to 9090.
#   port connect: If True, connects to ROS. If False, disconnects from ROS. Defaults to False.
#   port ros_client: The ROS client.
#   port is_connected: True if connection established.
# ---------- ros: Python ----------
"""
Connect or disconnect to ROS.

COMPAS FAB v0.19.1
"""
from ghpythonlib.componentbase import executingcomponent as component
from scriptcontext import sticky as st

from compas_fab.backends import RosClient
from compas_fab.ghpython.components import create_id


class ROSConnect(component):
    def RunScript(self, ip, port, connect):
        ros_client = None

        ip = ip or '127.0.0.1'
        port = port or 9090

        key = create_id(self, 'ros_client')
        ros_client = st.get(key, None)

        if ros_client:
            st[key].close()
        if connect:
            st[key] = RosClient(ip, port)
            st[key].run(5)

        ros_client = st.get(key, None)
        is_connected = ros_client.is_connected if ros_client else False
        return (ros_client, is_connected)
# ---------- end ros ----------
data_7 = Data(ros.ros_client)
robot = ROSRobot(ros_client=data_7, load=Toggle(True))  # -> robot; inputs load: Boolean
#   port ros_client: The ROS client.
#   port load: If True, loads the robot from ROS. Defaults to False.
# ---------- robot: Python ----------
"""
Load robot directly from ROS.

COMPAS FAB v0.19.1
"""
from compas_ghpython.artists import RobotModelArtist
from ghpythonlib.componentbase import executingcomponent as component
from scriptcontext import sticky as st

from compas_fab.ghpython.components import create_id


class ROSRobot(component):
    def RunScript(self, ros_client, load):
        key = create_id(self, 'robot')

        if ros_client and ros_client.is_connected and load:
            # Load URDF from ROS
            st[key] = ros_client.load_robot(load_geometry=True, precision='12f')
            st[key].artist = RobotModelArtist(st[key].model)

        robot = st.get(key, None)
        if robot:  # client sometimes need to be restarted, without needing to reload geometry
            robot.client = ros_client
        return robot
# ---------- end robot ----------
data_8 = Data(robot)

python_4 = GhPythonScript(robot=data_8, reset=Button())  # -> out, a
# ---------- python_4: Python ----------
print robot.info()

print robot.get_configurable_joint_names()
print robot.zero_configuration()
# ---------- end python_4 ----------

# ----
# If axis is included then allow the robot to move along track
list = ValueList({"Robot 1": "robot1", "Robot 2": "robot2", "Robot 1 axis": "robot1_axis", "Robot 2 axis": "robot2_axis", "Robot 1 axis gripper": "robot1_axis_gripper", "Robot 2 axis gripper": "robot2_axis_gripper"}, selected="Robot 1 axis gripper")
list_2 = ValueList({"Robot 1": "robot1", "Robot 2": "robot2", "Robot 1 axis": "robot1_axis", "Robot 2 axis": "robot2_axis", "Robot 1 axis gripper": "robot1_axis_gripper", "Robot 2 axis gripper": "robot2_axis_gripper"}, selected="Robot 2 axis gripper")
rob_num = Number(panel_2)
list_3 = ValueList({"platform": "ecl_platform", "world": "ecl_zero", "wobj_1": "rob1_acadia_EBIT_01", "wobj_2": "rob2_acadia_EBIT_01"}, selected="wobj_2")
list_4 = ValueList({"platform": "ecl_platform", "world": "ecl_zero", "wobj_1": "rob1_acadia_EBIT_01", "wobj_2": "rob2_acadia_EBIT_01"}, selected="wobj_1")
data_9 = Data(list)
data_10 = Data(list_2)
panel_7 = Panel(rob_num)
panel_8 = Panel(rob_num)
filter = StreamFilter(Gate=panel_8, Stream1=list_4, Stream2=list_3)
filter_2 = StreamFilter(Gate=panel_7, Stream1=data_9, Stream2=data_10)
data_11 = Data(filter)
data_12 = Data(filter_2)

panel_9 = Panel(python_4.out)

# ----
# Robot 1
j6 = Slider(0, range=-400..400)
j1 = Slider(0, range=-180..180)
j2 = Slider(0, range=-90..150)
j3 = Slider(0, range=-180..75)
j4 = Slider(0, range=-400..400)
j5 = Slider(0, range=-125..120)
# FK - Preset Configs
track = Slider(0, range=0..4)
data_13 = Data([j1, j2, j3, j4, j5, j6, track])

# ----
# ROBOT2
panel_10 = Panel("3246.00")
pt_2 = ConstructPoint(XCoordinate=panel_10, YCoordinate="1836.50", ZCoordinate="733.40")
Z = UnitZ(Factor="450.00")
division = Division(A=pt_2, B=1000)
division_2 = Division(A=Z, B=1000)
pl = ConstructPlane(Origin=division, XAxis=Vector(-1, 0, 0), YAxis=Vector(0, 1, 0))
pl_2 = ConstructPlane(Origin=pt_2, XAxis=Vector(-1, 0, 0), YAxis=Vector(0, 1, 0))
move = Move(Geometry=pl, Motion=division_2)  # -> Geometry, Transform
move_2 = Move(Geometry=pl_2, Motion=Z)  # -> Geometry, Transform
pln = Plane(move.Geometry)
pln_2 = Plane(pl)
pln_3 = Plane(move_2.Geometry)
pln_4 = Plane(pl_2)

# ----
# Robot 2
j6_2 = Slider(0, range=-400..400)
j1_2 = Slider(0, range=-180..180)
j2_2 = Slider(0, range=-90..150)
j3_2 = Slider(0, range=-180..75)
j4_2 = Slider(0, range=-400..400)
j5_2 = Slider(0, range=-125..120)
track_2 = Slider(4, range=0..4)
data_14 = Data([j1_2, j2_2, j3_2, j4_2, j5_2, j6_2, track_2])

# ----
# Planning Preset
python_5 = GhPythonScript()  # -> out, config
# ---------- python_5: Python ----------
#ROBOT 1 CONFIG
#Start path planning from

#axis 1-6 + track (mm)
config = [
-37.57,
-3.24,
8.36,
0.19,
84.45,
230,
100]

#config = [
#-37.57,
#-3.24,
#8.36,
#0.19,
#84.45,
#230,
#100]
# ---------- end python_5 ----------
python_6 = GhPythonScript()  # -> out, config
# ---------- python_6: Python ----------
#ROBOT 1 CONFIG
#Start path planning from

#axis 1-6 + track
config = [
40.55,
16.21,
-13.89,
-0.0,
87.68,
130.55,
3900]

#axis 1-6 + track
#config = [40.55,16.21,-13.89,-0.0,87.68,130.55,3900]
# ---------- end python_6 ----------
config = GhPythonScript(robot=data_8, r1=python_5.config, r2=python_6.config)  # -> config, config_scaled; inputs r1: list, r2: list
# ---------- config: Python ----------
import math

config = robot.zero_configuration()

for i in range(6):
    config['r1_joint_{}'.format(i + 1)] = r1[i]
    config['r2_joint_{}'.format(i + 1)] = r2[i]

#mm
config['r1_cart_joint'] = r1[6]
config['r2_cart_joint'] = r2[6]

print config

#for use in path planning
#radians and meters
config_scaled = robot.zero_configuration()

for i in range(6):
    config_scaled['r1_joint_{}'.format(i + 1)] = math.radians(r1[i])
    config_scaled['r2_joint_{}'.format(i + 1)] = math.radians(r2[i])

#mm --> m
config_scaled['r1_cart_joint'] = r1[6]/1000
config_scaled['r2_cart_joint'] = r2[6]/1000

print config_scaled
# ---------- end config ----------

# ----
# Return Preset
python_7 = GhPythonScript()  # -> out, config
# ---------- python_7: Python ----------
#RETURN CONFIG (BEFORE PICKUP)

#axis 1-6 + track (mm)
config = [
-90.0,
0.0,
0.0,
0.0,
90,
180,
100]
# ---------- end python_7 ----------
python_8 = GhPythonScript()  # -> out, config
# ---------- python_8: Python ----------
#RETURN CONFIG (BEFORE PICKUP)

#axis 1-6 + track
config = [
90.0,
0.0,
0.0,
0.0,
90,
180,
3900]
# ---------- end python_8 ----------
config_2 = GhPythonScript(robot=data_8, r1=python_7.config, r2=python_8.config)  # -> config, config_scaled; inputs r1: list, r2: list; same code as config

# ----
# SCENE COLLISION MESHES
scene = PlanningScene(robot=data_8)  # -> scene
#   port scene: A planning scene.
# ---------- scene: Python ----------
"""
Create a planning scene.

COMPAS FAB v0.19.1
"""
from ghpythonlib.componentbase import executingcomponent as component
from scriptcontext import sticky as st

from compas_fab.ghpython.components import create_id
from compas_fab.robots import PlanningScene


class PlanningSceneComponent(component):
    def RunScript(self, robot):
        key = create_id(self, 'planning_scene')
        if robot:
            st[key] = PlanningScene(robot)
        return st.get(key, None)
# ---------- end scene ----------

# ----
# FK
config_3 = GhPythonScript(robot=data_8, r1=data_13, r2=data_14)  # -> config; inputs r1: list, r2: list
# ---------- config_3: Python ----------
import math

config = robot.zero_configuration()

for i in range(6):
    config['r1_joint_{}'.format(i + 1)] = math.radians(r1[i])
    config['r2_joint_{}'.format(i + 1)] = math.radians(r2[i])

config['r1_cart_joint'] = r1[6]
config['r2_cart_joint'] = r2[6]

print config
# ---------- end config_3 ----------
gripper_frames = GhPythonScript(robot=data_8, config=config_3)  # -> out
# ---------- gripper_frames: Python ----------
print repr(robot.forward_kinematics(config, group='robot1_axis_gripper'))
print repr(robot.forward_kinematics(config, group='robot2_axis_gripper'))
# ---------- end gripper_frames ----------
panel_11 = Panel(gripper_frames)

mesh = Mesh(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)
cm = CollisionMesh(scene=scene, mesh=mesh, identifier="base_mesh", add=Button(), remove=Button())  # -> ok; inputs mesh: Mesh, add: Boolean, remove: Boolean
#   port scene: The planning scene.
#   port mesh: A collision mesh.
#   port identifier: The identifier of the collision mesh.
#   port add: If True, adds the collision mesh to the planning scene.
#   port remove: If True, removes the collision mesh from the planning scene.
#   port ok: True if the operation was successfully performed.
# ---------- cm: Python ----------
"""
Add or remove a collision mesh from the planning scene.

COMPAS FAB v0.19.1
"""
from compas_rhino.geometry import RhinoMesh
from ghpythonlib.componentbase import executingcomponent as component

from compas_fab.robots import CollisionMesh


class CollisionMeshComponent(component):
    def RunScript(self, scene, M, name, add, remove):
        ok = False
        if scene and M and name:
            mesh = RhinoMesh.from_geometry(M).to_compas()
            collision_mesh = CollisionMesh(mesh, name)
            if add:
                scene.add_collision_mesh(collision_mesh)
                ok = True
            if remove:
                scene.remove_collision_mesh(name)
                ok = True
        return ok
# ---------- end cm ----------
panel_12 = Panel(cm)

place_far = Slider(0.31, range=0..1.5)
num = Number(place_far)

# ----
# INPUT PARAMETERS
# can update placement plane location manually during path planning or use default "place_far" value
panel_13 = Panel("C:/Users/Edvard/Documents/GitHub/ECL_robotic_cell/_ACADIA/input_data/")
panel_14 = Panel("C:/Users/Edvard/Documents/GitHub/ECL_robotic_cell/_ACADIA/input_data/")
python_9 = GhPythonScript(path=panel_14, filename="member_rotations.json", read_data=Toggle(True))  # -> data_out, rotations
# ---------- python_9: Python ----------
import os
from compas_fab.utilities import read_data_from_json
from compas_fab.robots import Configuration

if read_data:
    data = read_data_from_json(os.path.join(path, filename))
    
    
print len(data)
print data
print data['member_29']

rotations = []
for i in range(len(data)):
    rotations.append(data['member_{}'.format(i)])

print rotations
    
data_out = [data]
# ---------- end python_9 ----------
python_10 = GhPythonScript(path=panel_13, filename="input_params.json", read_data=Toggle(True))  # -> node_diameter, member_offset, cross_section, place_close, place_far
# ---------- python_10: Python ----------
import os
from compas_fab.utilities import read_data_from_json

if read_data:
    data = read_data_from_json(os.path.join(path, filename))

print data

node_diameter = data['node_diameter']
member_offset = data['member_dist_from_node']
cross_section = data['cross_section_dim']
place_far = data['offset_place_far']
place_close = data['offset_place_close']
# ---------- end python_10 ----------
data_15 = Data(python_9.rotations)
num_2 = Number(python_10.node_diameter)
num_3 = Number(python_10.member_offset)
num_4 = Number(python_10.cross_section)
num_5 = Number(python_10.place_close)
num_6 = Number(num)

# ---- group: cross-section
# 1 3/16" (30.16mm) section.
# this dist is to corner
panel_15 = Panel(num_4)
division_3 = Division(A=panel_15, B="sqrt(2)")
polygon = Polygon(Plane=PlaneXY(0, 0, 0), Radius=division_3, Segments="4", FilletRadius=0)  # -> Polygon, Length
rotate = Rotate(Geometry=polygon.Polygon, Angle=degrees("45"), Plane=PlaneXY(0, 0, 0))  # -> Geometry, Transform
crv_3 = Curve(rotate.Geometry)

# ----
num_7 = Number(python_10.place_far)
python_11 = GhPythonScript(rotations=python_9.data_out, path=panel_3, save_data=toggle)  # inputs rotations: list; disabled
# ---------- python_11: Python ----------
import os
from compas_fab.utilities import write_data_to_json

import json

rotations = rotations[0]

def write_json(target_path, target_file, data):
    if not os.path.exists(target_path):
        try:
            os.makedirs(target_path)
        except Exception as e:
            print(e)
            raise
    with open(os.path.join(target_path, target_file), 'w') as f:
        json.dump(data, f, indent=4, sort_keys=True)


write_json(path, 'my_json.json', rotations)
# ---------- end python_11 ----------

# ---- group: member info
len = Length(Curve=crv_2)
midpt = CurveMiddle(Curve=crv_2)
panel_16 = Panel(num_3)
panel_17 = Panel(num_2)
pl_3 = PlaneNormal(Origin=midpt, ZAxis=crv_2)
python_12 = GhPythonScript(radius=panel_17, offset=panel_16, len=len)  # -> z_factor; inputs len: list
# ---------- python_12: Python ----------
len_reduce = (radius + offset)*2

z_factor = [(l - len_reduce)/l for l in len]
# ---------- end python_12 ----------

# ---- group: member meshes
pframes = PerpFrames(Curve=crv_2, Count=1, Align=True)  # -> Frames, Parameters
crv_4 = Curve(crv_3)
orient = Orient(Geometry=crv_4, Source=PlaneXY(0, 0, 0), Target=simplify(pframes.Frames))  # -> Geometry, Transform
swp1 = Sweep1(Rail=graft(crv_2), Sections=orient.Geometry, Miter=1)

# ---- group: member rotations about axis
data_16 = Data(data_15)
data_17 = Data(data_2)
item_2 = ListItem(List=data_16, Index=data_17, Wrap=True)
panel_18 = Panel(item_2)

# ---- group: nodes
data_18 = Data(data_3)
data_19 = Data(data_4)
panel_19 = Panel(num_2)
item_3 = ListItem(List=data_18, Index=data_19, Wrap=True)
sph = Sphere(Base=item_3, Radius=panel_19)

# ----
# STRUCTURE AT CURRENT STAGE OF CONSTRUCTION
pln_5 = Plane(pl_3)
pt_3 = Point(midpt)

# ---- group: member placement planes (middle)
pln_6 = Plane(pln_5)
data_20 = Data(item_2)
pt_4 = Point(pt_3)
crv_5 = Curve(crv_2)
rot3d = Rotate3D(
    Geometry=simplify(graft(pln_6)),
    Angle=simplify(graft(data_20)),
    Center=simplify(graft(pt_4)),
    Axis=simplify(graft(crv_5)))  # -> Geometry, Transform
item_4 = ListItem(List=flatten(rot3d.Geometry), Index=panel_5, Wrap=True)
panel_20 = Panel(num_5)
panel_21 = Panel(num_6)
deplane = DeconstructPlane(Plane=item_4)  # -> Origin, XAxis, YAxis, ZAxis
multiplication = Multiplication(A=deplane.XAxis, B=panel_20)
multiplication_2 = Multiplication(A=deplane.XAxis, B=panel_21)
move_3 = Move(Geometry=deplane.Origin, Motion=expr("-x", multiplication))  # -> Geometry, Transform
move_4 = Move(Geometry=deplane.Origin, Motion=expr("-x", multiplication_2))  # -> Geometry, Transform
multiplication_3 = Multiplication(A=move_3.Geometry, B=1000)
multiplication_4 = Multiplication(A=move_4.Geometry, B=1000)
pl_4 = ConstructPlane(Origin=multiplication_3, XAxis=deplane.YAxis, YAxis=deplane.ZAxis)
pl_5 = ConstructPlane(Origin=move_3.Geometry, XAxis=deplane.YAxis, YAxis=deplane.ZAxis)
pl_6 = ConstructPlane(Origin=multiplication_4, XAxis=deplane.YAxis, YAxis=deplane.ZAxis)
pl_7 = ConstructPlane(Origin=move_4.Geometry, XAxis=deplane.YAxis, YAxis=deplane.ZAxis)

# ---- group: as-built structure collision mesh
mesh_2 = Mesh(swp1)
pln_7 = Plane(pln_5)
num_8 = Number(python_12)
scale_nu = ScaleNU(Geometry=simplify(mesh_2), Plane=simplify(graft(pln_7)), ScaleX=1, ScaleY=1, ScaleZ=simplify(graft(num_8)))  # -> Geometry, Transform
mesh_3 = Mesh(scale_nu.Geometry)
data_21 = Data(item_2)
pt_5 = Point(pt_3)
crv_6 = Curve(crv_2)
rot3d_2 = Rotate3D(
    Geometry=simplify(graft(mesh_3)),
    Angle=simplify(graft(data_21)),
    Center=simplify(graft(pt_5)),
    Axis=simplify(graft(crv_6)))  # -> Geometry, Transform
panel_22 = Panel(panel)
item_5 = ListItem(List=flatten(rot3d_2.Geometry), Index=panel_22, Wrap=True)
mesh_4 = Mesh(rot3d_2.Geometry)

# ---- group: current member collision mesh (at 0,0,0)
num_9 = Number(python_12)
num_10 = Number(len)
panel_23 = Panel(num_4)
panel_24 = Panel(num_4)
multiplication_5 = Multiplication(A=num_9, B=num_10)
box = CenterBox(Base=PlaneXY(0, 0, 0), X=expr("x/2", multiplication_5), Y=expr("x/2", panel_23), Z=expr("x/2", panel_24))
mesh_5 = Mesh(box)
panel_25 = Panel(panel)
item_6 = ListItem(List=flatten(mesh_5), Index=panel_25, Wrap=True)

# ---- group: current member place planes
pln_8 = Plane(pl_7)
# VIZUALIZE
pln_9 = Plane(pl_5)
merge = Merge(Data1=pln_9, Data2=pln_8)
preview = CustomPreview(Geometry=merge, Material=ColourSwatch(SwatchColor=RGB(4, 0, 255)))

# ---- group: structure built so far
mesh_6 = Mesh(flatten(mesh_4))
shift = ShiftList(List=mesh_6, Shift=-1, Wrap=False)
preview_2 = CustomPreview(Geometry=shift, Material=ColourSwatch(SwatchColor=RGB(124, 125, 59)))

# ---- group: nodes
mesh_7 = Mesh(flatten(sph))
preview_3 = CustomPreview(Geometry=mesh_7, Material=ColourSwatch(SwatchColor=RGB(112, 129, 255)))

# ---- group: current member
mesh_8 = Mesh(flatten(item_5))
preview_4 = CustomPreview(Geometry=mesh_8, Material=ColourSwatch(SwatchColor=RGB(4, 0, 255)))

# ----
mesh_9 = Mesh(flatten(mesh_4))
shift_2 = ShiftList(List=flatten(mesh_9), Shift=-1, Wrap=False)
mjoin = MeshJoin(Meshes=shift_2)
cm_2 = CollisionMesh(scene=scene, mesh=simplify(mjoin), identifier="structure_mesh", add=Button(), remove=Button())  # -> ok; inputs mesh: Mesh, add: Boolean, remove: Boolean; same code as cm
panel_26 = Panel(cm_2)

mesh_10 = Mesh(item_6)
acm = AttachedCollisionMesh(
    scene=scene,
    mesh=mesh_10,
    identifier="member",
    link_name="r1_tcp",
    touch_links="r1_gripper",
    add=Button(),
    remove=Button())  # -> attached_collision_mesh; inputs mesh: Mesh, touch_links: list, add: Boolean, remove: Boolean
#   port scene: The planning scene.
#   port mesh: A collision mesh.
#   port identifier: The identifier of the collision mesh.
#   port link_name: The robot's link name to attach the mesh to.
#   port touch_links: Names of links that the robot is allowed to touch.
#   port add: If True, adds the collision mesh to the planning scene.
#   port remove: If True, removes the collision mesh from the planning scene.
#   port attached_collision_mesh: A collision mesh that is attached to a robot's link.
# ---------- acm: Python ----------
"""
Add an attached collision mesh to the robot.

COMPAS FAB v0.19.1
"""
from ghpythonlib.componentbase import executingcomponent as component

from compas_rhino.geometry import RhinoMesh
from compas_fab.robots import AttachedCollisionMesh
from compas_fab.robots import CollisionMesh


class AttachedCollisionMeshComponent(component):
    def RunScript(self, scene, mesh, identifier, link_name, touch_links, add, remove):
        attached_collision_mesh = None
        if scene and mesh and identifier and link_name:
            compas_mesh = RhinoMesh.from_geometry(mesh).to_compas()
            collision_mesh = CollisionMesh(compas_mesh, identifier)
            attached_collision_mesh = AttachedCollisionMesh(collision_mesh, link_name, touch_links)
            if add:
                scene.add_attached_collision_mesh(attached_collision_mesh)
            if remove:
                scene.remove_attached_collision_mesh(identifier)
                scene.remove_collision_mesh(identifier)
        return attached_collision_mesh
# ---------- end acm ----------

mesh_11 = Mesh(item_6)
acm_2 = AttachedCollisionMesh(
    scene=scene,
    mesh=mesh_11,
    identifier="member",
    link_name="r2_tcp",
    touch_links="r2_gripper",
    add=Button(),
    remove=Button())  # -> attached_collision_mesh; inputs mesh: Mesh, touch_links: list, add: Boolean, remove: Boolean; same code as acm

panel_27 = Panel("PLACE PLANE")
panel_28 = Panel("APPROACH PLANE")
pln_10 = Plane(pl_7)
pln_11 = Plane(pl_5)

panel_29 = Panel("C:\Users\Edvard\Documents\GitHub\workshop_princeton_2021\ACADIA\input_data\workshop_paths")

# ---- group: choose robot to send to
# SEND ROBOT COMMANDS
data_22 = Data(data_7)
panel_31 = Panel(rob_num)
panel_32 = Panel(data_11)

# ---- group: 1. return configuration
data_23 = Data(config_2.config)
button = Button()

# ---- group: pickup member planes
pln_12 = Plane(pln)
pln_13 = Plane(pln_2)

# ----
# IK
panel_33 = Panel(rob_num)
pln_14 = Plane(pln)
use_fk_as_start = BooleanToggle(True)
filter_3 = StreamFilter(Gate=use_fk_as_start)

# ----
# ROBOT1
panel_34 = Panel("3246.00")
pt_6 = ConstructPoint(XCoordinate=panel_34, YCoordinate="1838.30", ZCoordinate="729.60")
Z_2 = UnitZ(Factor="450.00")
division_4 = Division(A=pt_6, B=1000)
division_5 = Division(A=Z_2, B=1000)
pl_8 = ConstructPlane(Origin=division_4, XAxis=Vector(-1, 0, 0), YAxis=Vector(0, 1, 0))
move_5 = Move(Geometry=pl_8, Motion=division_5)  # -> Geometry, Transform
pln_15 = Plane(move_5.Geometry)
pln_16 = Plane(pl_8)

# ---- group: pickup member planes (continued)
pln_17 = Plane(pln_15)
pln_18 = Plane(pln_16)
merge_2 = Merge(Data1=pln_17, Data2=pln_18, Data3=pln_12, Data4=pln_13)
preview_5 = CustomPreview(
    Geometry=merge_2,
    Material={diffuse=RGB(0, 238, 255), emission=RGB(0, 71, 76), shine=0.5, specular=RGB(255, 255, 255), transparency=0})

# ----
pln_19 = Plane(pln_15)
filter_4 = StreamFilter(Gate=panel_33, Stream1=pln_19, Stream2=pln_14)
ik = InverseKinematics(robot=data_8, plane=filter_4, start_configuration=config_3, group=data_12)  # -> configuration
#   port plane: The plane or frame to calculate the inverse kinematic for.
#   port start_configuration: If passed, calculates the inverse such that the joint positions differ the least from the start_configuration. Defaults to the zero configuration.
#   port group: The planning group used for calculation. Defaults to the robot's main planning group.
#   port configuration: The planning group's configuration.
# ---------- ik: Python ----------
"""
Calculate the robot's inverse kinematic for a given plane.

COMPAS FAB v0.19.1
"""
from ghpythonlib.componentbase import executingcomponent as component

from compas_fab.ghpython.components import coerce_frame


class InverseKinematics(component):
    def RunScript(self, robot, plane, start_configuration, group):
        configuration = None
        if robot and robot.client and robot.client.is_connected and plane:
            frame = coerce_frame(plane)
            configuration = robot.inverse_kinematics(frame, start_configuration, group)
        if start_configuration:
            return start_configuration.merged(configuration)
        else:
            return configuration
# ---------- end ik ----------

# ----
# MEMBER PICKUP PLANES
pl_9 = ConstructPlane(Origin=pt_6, XAxis=Vector(-1, 0, 0), YAxis=Vector(0, 1, 0))

move_6 = Move(Geometry=pl_9, Motion=Z_2)  # -> Geometry, Transform
pln_20 = Plane(move_6.Geometry)
pln_21 = Plane(pl_9)

# ---- group: send pickup planes
python_13 = GhPythonScript()  # -> t_a
# ---------- python_13: Python ----------
from compas.geometry import Frame
from compas.geometry import Point
from compas_ghpython import draw_frame
from compas.geometry import Transformation

from compas_rhino.geometry import RhinoPlane

wobj_A = Frame.from_quaternion([0.999964,0.00426176,-0.00158504,-0.00717332])
wobj_A.point = [-681.039,1564.71,817.284]

f_a = RhinoPlane.from_geometry(wobj_A).to_compas() 
print(f_a)

t_a = Transformation.from_frame(f_a)
print t_a
# ---------- end python_13 ----------
merge_3 = Merge(Data1=pln_20, Data2=pln_21)
merge_4 = Merge(Data1=pln_3, Data2=pln_4)
python_14 = GhPythonScript(p_send=merge_3, t_a=python_13)  # -> f_send; inputs p_send: list
# ---------- python_14: Python ----------
from compas.geometry import Frame
from compas_ghpython import draw_frame
from compas_rhino.geometry import RhinoPlane
#
f_send = []
for p in p_send:
    f = RhinoPlane.from_geometry(p).to_compas()
    f_trans = f.transformed(t_a.inverse())
    f_send.append(f_trans)
    
print f_send
# ---------- end python_14 ----------
python_15 = GhPythonScript(p_send=merge_4, t_a=python_13)  # -> f_send; inputs p_send: list; same code as python_14

# ----
list_5 = ValueList({"Forward Kinematics": 0, "Inverse Kinematics": 1, "Preset Start Planning Config": 2, "Preset Return Config": 3}, selected="Preset Start Planning Config")
filter_5 = StreamFilter(Gate=list_5, Stream0=config_3, Stream1=ik, Stream2=config.config_scaled, Stream3=config_2.config_scaled)
robot_visualize = RobotVisualize(robot=data_8, configuration=filter_5)  # -> visual, collision, attached_meshes, frames, base_frame, ee_frame; inputs attached_collision_meshes: list, show_visual: Boolean, show_collision: Boolean, show_frames: Boolean, show_base_frame: Boolean, show_end_effector_frame: Boolean, show_acm: Boolean
#   port group: The planning group used for end-effector and base visualization.
#   port configuration: The robot's full configuration.
#   port attached_collision_meshes: A list of attached collision meshes.
#   port show_visual: Whether or not to show the robot's visual meshes.
#   port show_collision: Whether or not to show the robot's collision meshes.
#   port show_frames: Whether or not to show the robot's joint frames.
#   port show_base_frame: Whether or not to show the robot's base frame.
#   port show_end_effector_frame: Whether or not to show the robot's end-effector frame.
#   port show_acm: Whether or not to show the attached collision meshes (if any).
#   port visual: The robot's visual Rhino meshes (if any).
#   port collision: The robot's collision Rhino meshes (if any).
#   port attached_meshes: The attached collision Rhino meshes (if any).
#   port frames: The robot's joint frames as Rhino planes (if any).
#   port base_frame: The robot's base frame as a Rhino plane (if any).
#   port ee_frame: The robot's end-effector frame as a Rhino plane (if any).
# ---------- robot_visualize: Python ----------
"""
Visualizes the robot.

COMPAS FAB v0.19.1
"""
from compas.geometry import Frame
from compas.geometry import Transformation
from compas_ghpython.artists import FrameArtist
from compas_ghpython.artists import MeshArtist
from ghpythonlib.componentbase import executingcomponent as component


class RobotVisualize(component):
    def RunScript(self, robot, group, configuration, attached_collision_meshes, show_visual, show_collision,
                  show_frames, show_base_frame, show_end_effector_frame, show_acm):

        visual = None
        collision = None
        attached_meshes = None
        frames = None
        base_frame = None
        ee_frame = None

        if robot:
            show_visual = True if show_visual is None else show_visual
            configuration = configuration or robot.zero_configuration()

            robot.update(configuration, visual=show_visual, collision=show_collision)
            compas_frames = robot.transformed_frames(configuration, group)

            if show_visual:
                visual = robot.artist.draw_visual()

            if show_collision:
                collision = robot.artist.draw_collision()

            if show_base_frame:
                base_compas_frame = compas_frames[0]
                artist = FrameArtist(base_compas_frame)
                base_frame = artist.draw()

            if show_end_effector_frame:
                ee_compas_frame = robot.forward_kinematics(configuration, group, options=dict(solver='model'))
                artist = FrameArtist(ee_compas_frame)
                ee_frame = artist.draw()

            if show_frames:
                frames = []
                for compas_frame in compas_frames[1:]:
                    artist = FrameArtist(compas_frame)
                    frame = artist.draw()
                    frames.append(frame)

            if show_acm:
                attached_meshes = []
                for acm in attached_collision_meshes:
                    frame = robot.forward_kinematics(configuration, options=dict(solver='model', link_name=acm.link_name))
                    T = Transformation.from_frame_to_frame(Frame.worldXY(), frame)
                    mesh = acm.collision_mesh.mesh.transformed(T)
                    attached_meshes.append(MeshArtist(mesh).draw())

        return (visual, collision, attached_meshes, frames, base_frame, ee_frame)
# ---------- end robot_visualize ----------

# ---- group: plan path
# PATH PLANNING (START)
constraints_from_plane = ConstraintsFromPlane(robot=data_8, plane=pln_10, group=data_12)  # -> constraints
#   port plane: The plane or frame from which we create position and orientation constraints.
#   port group: The planning group for which we specify the constraint. Defaults to the robot's main planning group.
#   port tolerance_position: The allowed tolerance to the frame's position (defined in the robot's units). Defaults to 0.001
#   port tolerance_xaxis: The allowed tolerance of the frame's X-axis in degrees.
#   port tolerance_yaxis: The allowed tolerance of the frame's Y-axis in degrees.
#   port tolerance_zaxis: The allowed tolerance of the frame's Z-axis in degrees.
#   port constraints: A list containing a position and an orientation constraint.
# ---------- constraints_from_plane: Python ----------
"""
Create a position and an orientation constraint from a plane calculated for the group's end-effector link.

COMPAS FAB v0.19.1
"""
import math

from ghpythonlib.componentbase import executingcomponent as component

from compas_fab.ghpython.components import coerce_frame


class ConstraintsFromPlane(component):
    def RunScript(self, robot, plane, group, tolerance_position, tolerance_xaxis, tolerance_yaxis, tolerance_zaxis):
        goal_constraints = None
        if robot and plane:
            tolerance_position = tolerance_position or 0.001
            tolerance_xaxis = tolerance_xaxis or 1.
            tolerance_yaxis = tolerance_yaxis or 1.
            tolerance_zaxis = tolerance_zaxis or 1.

            frame = coerce_frame(plane)
            tolerances_axes = [math.radians(tolerance_xaxis), math.radians(tolerance_yaxis), math.radians(tolerance_zaxis)]
            goal_constraints = robot.constraints_from_frame(frame, tolerance_position, tolerances_axes, group)

        return goal_constraints
# ---------- end constraints_from_plane ----------
plan_motion = PlanMotion(robot=data_8, goal_constraints=constraints_from_plane, start_configuration=filter_5, group=data_12, compute=Button())  # -> trajectory; inputs goal_constraints: list, attached_collision_meshes: list of Mesh, path_constraints: list, compute: Boolean
#   port goal_constraints: The goal to be achieved, defined in a set of constraints. Constraints can be very specific, for example defining value domains for each joint, such that the goal configuration is included, or defining a volume in space, to which a specific robot link (e.g. the end-effector) is required to move to.
#   port start_configuration: The robot's full configuration, i.e. values for all configurable joints of the entire robot, at the starting position. Defaults to the all-zero configuration.
#   port group: The planning group used for calculation. Defaults to the robot's main planning group.
#   port attached_collision_meshes: A list of attached collision meshes to be included for planning.
#   port path_constraints: Optional constraints that can be imposed along the solution path. Note that path calculation won't work if the start_configuration violates these constraints. Defaults to None.
#   port planner_id: The name of the algorithm used for path planning. Defaults to 'RRTConnectkConfigDefault'
#   port compute: If True, calculates a trajectory.
#   port trajectory: The calculated trajectory.
# ---------- plan_motion: Python ----------
"""
Calculate a motion path.

COMPAS FAB v0.19.1
"""
from ghpythonlib.componentbase import executingcomponent as component
from scriptcontext import sticky as st

from compas_fab.ghpython.components import create_id


class PlanMotion(component):
    def RunScript(self, robot, goal_constraints, start_configuration, group, attached_collision_meshes, path_constraints, planner_id, compute):

        key = create_id(self, 'trajectory')

        path_constraints = list(path_constraints) if path_constraints else None
        attached_collision_meshes = list(attached_collision_meshes) if attached_collision_meshes else None
        planner_id = str(planner_id) if planner_id else 'RRTConnectkConfigDefault'

        if robot and robot.client and robot.client.is_connected and start_configuration and goal_constraints and compute:
            st[key] = robot.plan_motion(goal_constraints,
                                        start_configuration=start_configuration,
                                        group=group,
                                        options=dict(
                                            attached_collision_meshes=attached_collision_meshes,
                                            path_constraints=path_constraints,
                                            planner_id=planner_id,
                                        ))

        trajectory = st.get(key, None)
        return trajectory
# ---------- end plan_motion ----------
trajectory_visualize = TrajectoryVisualize(robot=data_8, group=data_12, trajectory=plan_motion)  # -> start_configuration, configurations, fraction, time, planes, P, V, A
#   port group: The planning group for which this trajectory was planned.
#   port trajectory: The calculated trajectory.
#   port start_configuration: The start configuration of the trajectory.
#   port configurations: The full configurations along the trajectory.
#   port fraction: Indicates the fraction of requested trajectory that was calculated, e.g. 1 means the full trajectory was found.
#   port time: The time which is needed to execute that trajectory at full speed.
#   port planes: The planes of the robot's end-effector.
#   port P: The positions along the trajectory
#   port V: The velocities along the trajectory
#   port A: The accelerations along the trajectory
# ---------- trajectory_visualize: Python ----------
"""
Visualizes a trajectory.

COMPAS FAB v0.19.1
"""
from compas_ghpython import draw_frame
from compas_ghpython import list_to_ghtree
from ghpythonlib.componentbase import executingcomponent as component


class TrajectoryVisualize(component):
    def RunScript(self, robot, group, trajectory):
        start_configuration = None
        configurations = []
        fraction = 0.
        time = 0.

        planes = []
        positions = []
        velocities = []
        accelerations = []

        if robot and trajectory:
            group = group or robot.main_group_name

            for c in trajectory.points:
                configurations.append(robot.merge_group_with_full_configuration(c, trajectory.start_configuration, group))
                frame = robot.forward_kinematics(c, group, options=dict(solver='model'))
                planes.append(draw_frame(frame))
                positions.append(c.positions)
                velocities.append(c.velocities)
                accelerations.append(c.accelerations)

            start_configuration = trajectory.start_configuration
            fraction = trajectory.fraction
            time = trajectory.time_from_start

        P = list_to_ghtree(list(zip(*positions)))
        V = list_to_ghtree(list(zip(*velocities)))
        A = list_to_ghtree(list(zip(*accelerations)))

        # return outputs if you have them; here I try it for you:
        return (start_configuration, configurations, fraction, time, planes, P, V, A)
# ---------- end trajectory_visualize ----------

# ---- group: save new planned path
panel_35 = Panel("C:/Users/Edvard/Documents/GitHub/workshop_princeton_2021/workshop_ACADIA/input_data/planned_paths")
save_data = Button()
panel_36 = Panel(panel)
python_16 = GhPythonScript(configs=trajectory_visualize.configurations, path=panel_35, member_num=panel_36, save_data=save_data)  # inputs configs: list
# ---------- python_16: Python ----------
import os
from compas_fab.utilities import write_data_to_json

configs_combined = {}
if save_data:
    for i,c in enumerate(configs):
        configs_combined['config_{}'.format(i)] = c.to_data()
        #c.to_json(os.path.join(path, 'member_{}/config_{}.json'.format(member_num,i)))

    print configs_combined
    write_data_to_json(configs_combined, os.path.join(path, 'member_{}_start.json'.format(member_num)))
# ---------- end python_16 ----------

# ----
list_6 = ValueList({"Use new planned path": 0, "Load saved path": 1}, selected="Use new planned path")
python_17 = GhPythonScript(path=panel_35, member_num=panel_36, read_data=list_6)  # -> configs
# ---------- python_17: Python ----------
import os
from compas_fab.utilities import read_data_from_json
from compas_fab.robots import Configuration

if read_data:
    data = read_data_from_json(os.path.join(path, 'member_{}_start.json'.format(member_num)))

    print data['config_1']
    print len(data)

configs = []
for i in range(len(data)):
    configs.append(Configuration.from_data(data['config_{}'.format(i)]))
    
print configs[1]
   
print configs[0]['r1_joint_6']
# ---------- end python_17 ----------
filter_6 = StreamFilter(Gate=list_6, Stream0=trajectory_visualize.configurations, Stream1=python_17)
data_24 = Data(filter_6)

# ---- group: plan path
# start from the last config path of "start" path plan
data_25 = Data(data_24)
item_7 = ListItem(List=data_25, Index="-1", Wrap=True)

# PATH PLANNING (END)
constraints_from_plane_2 = ConstraintsFromPlane(robot=data_8, plane=pln_11, group=data_12)  # -> constraints; same code as constraints_from_plane
plan_motion_2 = PlanMotion(robot=data_8, goal_constraints=constraints_from_plane_2, start_configuration=item_7, group=data_12, compute=Button())  # -> trajectory; inputs goal_constraints: list, attached_collision_meshes: list of Mesh, path_constraints: list, compute: Boolean; same code as plan_motion
trajectory_visualize_2 = TrajectoryVisualize(robot=data_8, group=data_12, trajectory=plan_motion_2)  # -> start_configuration, configurations, fraction, time, planes, P, V, A; same code as trajectory_visualize

# ---- group: save new planned path
save_data_2 = Button()
panel_37 = Panel("C:/Users/Edvard/Documents/GitHub/workshop_princeton_2021/workshop_ACADIA/input_data/planned_paths")
panel_38 = Panel(panel)
python_18 = GhPythonScript(configs=trajectory_visualize_2.configurations, path=panel_37, member_num=panel_38, save_data=save_data_2)  # inputs configs: list
# ---------- python_18: Python ----------
import os
from compas_fab.utilities import write_data_to_json

configs_combined = {}
if save_data:
    for i,c in enumerate(configs):
        configs_combined['config_{}'.format(i)] = c.to_data()
        #c.to_json(os.path.join(path, 'member_{}/config_{}.json'.format(member_num,i)))

    #print configs_combined
    write_data_to_json(configs_combined, os.path.join(path, 'member_{}_end.json'.format(member_num)))
# ---------- end python_18 ----------

# ----
list_7 = ValueList({"Use new planned path": 0, "Load saved path": 1}, selected="Use new planned path")
python_19 = GhPythonScript(path=panel_37, member_num=panel_38, read_data=list_7)  # -> configs
# ---------- python_19: Python ----------
import os
from compas_fab.utilities import read_data_from_json
from compas_fab.robots import Configuration

if read_data:
    data = read_data_from_json(os.path.join(path, 'member_{}_end.json'.format(member_num)))

    print data['config_1']
    print len(data)

configs = []
for i in range(len(data)):
    configs.append(Configuration.from_data(data['config_{}'.format(i)]))
    
print configs[1]
# ---------- end python_19 ----------
filter_7 = StreamFilter(Gate=list_7, Stream0=trajectory_visualize_2.configurations, Stream1=python_19)
data_26 = Data(filter_7)

# ---- group: visualize robot path
item_8 = ListItem(List=data_24, Index=Slider(0, range=0..50), Wrap=False)
robot_visualize_2 = RobotVisualize(robot=data_8, configuration=item_8)  # -> visual, collision, attached_meshes, frames, base_frame, ee_frame; inputs attached_collision_meshes: list, show_visual: Boolean, show_collision: Boolean, show_frames: Boolean, show_base_frame: Boolean, show_end_effector_frame: Boolean, show_acm: Boolean; same code as robot_visualize

# ---- group: vizualize robot path
item_9 = ListItem(List=data_26, Index=Slider(0, range=0..50), Wrap=False)
robot_visualize_3 = RobotVisualize(robot=data_8, configuration=item_9)  # -> visual, collision, attached_meshes, frames, base_frame, ee_frame; inputs attached_collision_meshes: list, show_visual: Boolean, show_collision: Boolean, show_frames: Boolean, show_base_frame: Boolean, show_end_effector_frame: Boolean, show_acm: Boolean; same code as robot_visualize

# ---- group: paths to send
python_20 = GhPythonScript(configs=data_24)  # -> out, r1_place, r2_place; inputs configs: list
# ---------- python_20: Python ----------
import math
import compas_rrc as rrc

#configs = configs
    
r1_place = []
r2_place = []
for c in configs:
    r1_axes = rrc.ExternalAxes(c['r1_cart_joint']*1000)
    r1_joints = rrc.RobotJoints(
        math.degrees(c['r1_joint_1']),
        math.degrees(c['r1_joint_2']),
        math.degrees(c['r1_joint_3']),
        math.degrees(c['r1_joint_4']),
        math.degrees(c['r1_joint_5']),
        math.degrees(c['r1_joint_6']),
    )
    
    r2_axes = rrc.ExternalAxes(c['r2_cart_joint']*1000)
    r2_joints = rrc.RobotJoints(
        math.degrees(c['r2_joint_1']),
        math.degrees(c['r2_joint_2']),
        math.degrees(c['r2_joint_3']),
        math.degrees(c['r2_joint_4']),
        math.degrees(c['r2_joint_5']),
        math.degrees(c['r2_joint_6']),
    )
    
    r1_place.append([r1_axes, r1_joints])
    r2_place.append([r2_axes, r2_joints])
# ---------- end python_20 ----------
data_27 = Data(python_20.r1_place)
data_28 = Data(python_20.r2_place)

python_21 = GhPythonScript(configs=data_26)  # -> out, r1_place, r2_place; inputs configs: list; same code as python_20
data_29 = Data(python_21.r1_place)
data_30 = Data(python_21.r2_place)

# ---- group: 2. pick member path
data_31 = Data(python_14)
data_32 = Data(python_15)
button_2 = Button()
data_33 = Data(config.config)

# ---- group: 3. path plan (start)
button_3 = Button()
data_34 = Data(data_27)
data_35 = Data(data_28)

# ---- group: 4. path plan (end)
button_4 = Button()
data_36 = Data(data_29)
data_37 = Data(data_30)

# ----
python_22 = GhPythonScript(
    ros=data_22,
    rob_num=panel_31,
    wobj=panel_32,
    return_config=data_23,
    send_return=button,
    r1_pick_path=data_31,
    r2_pick_path=data_32,
    pick_config=data_33,
    send_pick=button_2,
    r1_place_startpath=data_34,
    r2_place_startpath=data_35,
    send_place_start=button_3,
    r1_place_endpath=data_36,
    r2_place_endpath=data_37,
    send_place_end=button_4,
    get_info=Toggle(False))  # -> out, current_joints; inputs rob_num: Int32, r1_pick_path: list, r2_pick_path: list, r1_place_startpath: list, r2_place_startpath: list, r1_place_endpath: list, r2_place_endpath: list
# ---------- python_22: Python ----------
import compas_rrc as rrc
from compas.geometry import Frame
from compas.geometry import Plane

from compas_rhino.geometry import RhinoPlane

print return_config
print pick_config

# Create ABB Client (rob2 = right, rob1 = left)
if rob_num == 1:
    abb = rrc.AbbClient(ros, '/rob1')
    abb.send(rrc.SetTool('ecl_pneumatic_gripper'))
    DO = 'do_1'
    pick_path = r1_pick_path
    path_place_s = r1_place_startpath
    path_place_e = r1_place_endpath
    #pick_track = 100
    
    print('Connected.')
elif rob_num == 2:
    abb = rrc.AbbClient(ros, '/rob2')
    abb.send(rrc.SetTool('ecl_pneumatic_gripper'))
    DO = 'do_2'
    pick_path = r2_pick_path
    path_place_s = r2_place_startpath
    path_place_e = r2_place_endpath
    #pick_track = 3888.11
    
    print('Connected.')

# Define speeds
speed = 100

# set wobj
abb.send(rrc.SetWorkObject(wobj))

if get_info:
    current_joints = abb.send_and_wait(rrc.GetJoints(),  timeout = 3)
    print current_joints
    

if send_return:
    
    if rob_num == 1:
        axis = rrc.ExternalAxes(return_config['r1_cart_joint'])
        joints = rrc.RobotJoints(
            return_config['r1_joint_1'],
            return_config['r1_joint_2'],
            return_config['r1_joint_3'],
            return_config['r1_joint_4'],
            return_config['r1_joint_5'],
            return_config['r1_joint_6'],
        )
    elif rob_num == 2:
        axis = rrc.ExternalAxes(return_config['r2_cart_joint'])
        joints = rrc.RobotJoints(
            return_config['r2_joint_1'],
            return_config['r2_joint_2'],
            return_config['r2_joint_3'],
            return_config['r2_joint_4'],
            return_config['r2_joint_5'],
            return_config['r2_joint_6'],
        )
        
    done = abb.send(rrc.MoveToJoints(joints, axis, speed, rrc.Zone.FINE))
    print('Finished')


if send_pick:
    #open gripper
    done = abb.send_and_wait(rrc.SetDigital(DO,0), timeout = 10)
    
    done = abb.send_and_wait(rrc.MoveToFrame(pick_path[0], speed, rrc.Zone.FINE), timeout = 30)
    future = abb.send(rrc.Stop(feedback_level=rrc.FeedbackLevel.DONE))
    
    done = abb.send_and_wait(rrc.MoveToFrame(pick_path[1], speed, rrc.Zone.FINE), timeout = 30)
    future = abb.send(rrc.Stop(feedback_level=rrc.FeedbackLevel.DONE))
        
    #close gripper
    done = abb.send_and_wait(rrc.SetDigital(DO,1), timeout = 10)
    
    #back to start frame
    done = abb.send_and_wait(rrc.MoveToFrame(pick_path[0], speed, rrc.Zone.FINE), timeout = 10)
    future = abb.send(rrc.Stop(feedback_level=rrc.FeedbackLevel.DONE))
    
    #Final hard-coded config, path planning starts from here
    if rob_num == 1:
        axis = rrc.ExternalAxes(pick_config['r1_cart_joint'])
        joints = rrc.RobotJoints(
            pick_config['r1_joint_1'],
            pick_config['r1_joint_2'],
            pick_config['r1_joint_3'],
            pick_config['r1_joint_4'],
            pick_config['r1_joint_5'],
            pick_config['r1_joint_6'],
        )
    elif rob_num == 2:
        axis = rrc.ExternalAxes(pick_config['r2_cart_joint'])
        joints = rrc.RobotJoints(
            pick_config['r2_joint_1'],
            pick_config['r2_joint_2'],
            pick_config['r2_joint_3'],
            pick_config['r2_joint_4'],
            pick_config['r2_joint_5'],
            pick_config['r2_joint_6'],
        )
        
    done = abb.send(rrc.MoveToJoints(joints, axis, speed, rrc.Zone.FINE))
    print('Finished')
    
    
if send_place_start:
    # execute planned path
    # formatted as RobotJoints and ExternalAxes object 
    
    last_axis, last_joints = path_place_s.pop(-1)
    
    for axis,joints in path_place_s:
        print axis, joints
        done = abb.send(rrc.MoveToJoints(joints, axis, speed, rrc.Zone.Z10))
    
    done = abb.send(rrc.MoveToJoints(last_joints, last_axis, speed, rrc.Zone.FINE))
    
    print('Finished')

if send_place_end:
    
    # execute planned path
    # formatted as RobotJoints and ExternalAxes object 
    
    last_axis, last_joints = path_place_e.pop(-1)
    
    for axis,joints in path_place_e:
        print axis, joints
        done = abb.send(rrc.MoveToJoints(joints, axis, speed/3, rrc.Zone.Z10))
        
    done = abb.send(rrc.MoveToJoints(last_joints, last_axis, speed/3, rrc.Zone.FINE))

    print('Finished')
# ---------- end python_22 ----------
panel_39 = Panel(python_22.out)
panel_40 = Panel(python_22.current_joints)
