# Grasshopper definition 3rob_cell_visualize.ghx (Grasshopper 1.0.7)

panel = Panel("ros-79hh-s4fg.yaler.io")
ros = ROSConnect(connect=Toggle(True))  # -> ros_client, is_connected; inputs port: Int32, connect: Boolean
#   port ip: The ip address ROS. Defaults to 127.0.0.1.
#   port port: The port of ROS. Defaults to 9090.
#   port connect: If True, connects to ROS. If False, disconnects from ROS. Defaults to False.
#   port ros_client: The ROS client.
#   port is_connected: True if connection established.
# ---------- ros: Python ----------
"""
Connect or disconnect to ROS.

COMPAS FAB v0.19.1
"""
from ghpythonlib.componentbase import executingcomponent as component
from scriptcontext import sticky as st

from compas_fab.backends import RosClient
from compas_fab.ghpython.components import create_id


class ROSConnect(component):
    def RunScript(self, ip, port, connect):
        ros_client = None

        ip = ip or '127.0.0.1'
        port = port or 9090

        key = create_id(self, 'ros_client')
        ros_client = st.get(key, None)

        if ros_client:
            st[key].close()
        if connect:
            st[key] = RosClient(ip, port)
            st[key].run(5)

        ros_client = st.get(key, None)
        is_connected = ros_client.is_connected if ros_client else False
        return (ros_client, is_connected)
# ---------- end ros ----------
data = Data(ros.ros_client)
robot = ROSRobot(ros_client=data, load=Toggle(True))  # -> robot; inputs load: Boolean
#   port ros_client: The ROS client.
#   port load: If True, loads the robot from ROS. Defaults to False.
# ---------- robot: Python ----------
"""
Load robot directly from ROS.

COMPAS FAB v0.19.1
"""
from compas_ghpython.artists import RobotModelArtist
from ghpythonlib.componentbase import executingcomponent as component
from scriptcontext import sticky as st

from compas_fab.ghpython.components import create_id


class ROSRobot(component):
    def RunScript(self, ros_client, load):
        key = create_id(self, 'robot')

        if ros_client and ros_client.is_connected and load:
            # Load URDF from ROS
            st[key] = ros_client.load_robot(load_geometry=True, precision='12f')
            st[key].artist = RobotModelArtist(st[key].model)

        robot = st.get(key, None)
        if robot:  # client sometimes need to be restarted, without needing to reload geometry
            robot.client = ros_client
        return robot
# ---------- end robot ----------
data_2 = Data(robot)

list = ValueList({"Robot 1": 1, "Robot 2": 2, "Robot 3": 3}, selected="Robot 2")

python = GhPythonScript()  # -> wobj2_mm, wobj2_m, draw_wobj2_m
# ---------- python: Python ----------
from compas.geometry import Frame
from compas_ghpython.artists import FrameArtist

#THIS IS WOBJ FOR R2
p = [3107.65,1478.91,367.994]
wobj2_mm = Frame.from_quaternion([0.99999,-0.00305874,-0.00165978,-0.0029736], p)

p = [3.10765,1.47891,0.367994]
wobj2_m = Frame.from_quaternion([0.99999,-0.00305874,-0.00165978,-0.0029736], p)

artist = FrameArtist(wobj2_m)
draw_wobj2_m = artist.draw()
# ---------- end python ----------
python_2 = GhPythonScript()  # -> wobj1_mm, draw_wobj1_m
# ---------- python_2: Python ----------
from compas.geometry import Frame
from compas_ghpython.artists import FrameArtist

#THIS IS WOBJ FOR R1
p=[3103.33,1481.11,366.83]
wobj1_mm = Frame.from_quaternion([0.999976,-0.00604606,-0.00149283,-0.0029774],p)

p=[3.10333,1.48111,0.36683]
wobj1_m = Frame.from_quaternion([0.999976,-0.00604606,-0.00149283,-0.0029774],p)

artist = FrameArtist(wobj1_m)
draw_wobj1_m = artist.draw()
# ---------- end python_2 ----------
python_3 = GhPythonScript()  # -> wobj3_m, draw_wobj3_m
# ---------- python_3: Python ----------
from compas.geometry import Frame
from compas_ghpython.artists import FrameArtist

#THIS IS WOBJ FOR R3
p = [1776.27,240.085,695.195]
wobj3_mm = Frame.from_quaternion([0.00447221,-0.000156608,-0.00949994,0.999945], p)

p = [1.77627,0.240085,0.695195]
wobj3_m = Frame.from_quaternion([0.00447221,-0.000156608,-0.00949994,0.999945], p)

artist = FrameArtist(wobj3_m)
draw_wobj3_m = artist.draw()
# ---------- end python_3 ----------
pln = Plane(python_2.draw_wobj1_m)
pln_2 = Plane(python.draw_wobj2_m)
pln_3 = Plane(python_3.draw_wobj3_m)

python_4 = GhPythonScript(wobj2_m=python.wobj2_m)  # -> test_point, draw_testpoint
# ---------- python_4: Python ----------
from compas.geometry import Frame
from compas.geometry import Point
from compas.geometry import Vector

from compas_ghpython.artists import FrameArtist
from compas_ghpython.artists import PointArtist
from compas.geometry import Translation

p = wobj2_m.point

##################
t = Translation.from_vector(wobj2_m.xaxis)
test_point = Point.from_data(p).transformed(t)
print test_point
##################


artist = PointArtist(test_point)
draw_testpoint = artist.draw()
# ---------- end python_4 ----------
pt = Point(python_4.draw_testpoint)

# ----
# ECL PLATFORM MESH
mesh = Mesh([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])  # disabled

# ----
# ROBOT CONNECT
rob_num = Number(list)

r2_tcp_frames = Panel("""x1: [Frame(Point(2.766932, 1.480845, 0.366978), Vector(1.000, 0.024, -0.017), Vector(0.030, -0.855, 0.518))]
x2: [Frame(Point(3.108758, 1.478910, 0.367960), Vector(1.000, 0.024, -0.017), Vector(0.030, -0.855, 0.518))]
y1: [Frame(Point(3.108797, 1.667304, 0.366823), Vector(1.000, 0.024, -0.017), Vector(0.030, -0.855, 0.518))]""")
r3_tcp_frames = Panel("""x1: [Frame(Point(2.117427, 0.237057, 0.695275), Vector(-0.831, 0.545, 0.109), Vector(0.377, 0.697, -0.610))]
x2: [Frame(Point(1.775055, 0.240101, 0.695195), Vector(-0.831, 0.545, 0.109), Vector(0.377, 0.697, -0.610))]
y1: [Frame(Point(1.774582, 0.051813, 0.691629), Vector(-0.831, 0.546, 0.109), Vector(0.377, 0.697, -0.610))]""")
r1_tcp_frames = Panel("""x1: [Frame(Point(2.762768, 1.483214, 0.365833), Vector(-0.797, -0.574, -0.189), Vector(-0.506, 0.805, -0.311))]
x2: [Frame(Point(3.104401, 1.481151, 0.366987), Vector(-0.797, -0.574, -0.189), Vector(-0.506, 0.805, -0.311))]
y1: [Frame(Point(3.104434, 1.669760, 0.364630), Vector(-0.797, -0.574, -0.189), Vector(-0.506, 0.805, -0.311))]""")
python_5 = GhPythonScript()  # -> frames_wobj
# ---------- python_5: Python ----------
from compas.geometry import Frame
from compas.geometry import Point
from compas.geometry import Vector

#R1 calibration resulting frames
frames_wobj = {
'x1':Frame(Point(2.766932, 1.480845, 0.366978), Vector(1.000, 0.024, -0.017), Vector(0.030, -0.855, 0.518)),
'x2':Frame(Point(3.108758, 1.478910, 0.367960), Vector(1.000, 0.024, -0.017), Vector(0.030, -0.855, 0.518)),
'y1':Frame(Point(3.108797, 1.667304, 0.366823), Vector(1.000, 0.024, -0.017), Vector(0.030, -0.855, 0.518))
}

frames_wobj = [frames_wobj]
# ---------- end python_5 ----------
python_6 = GhPythonScript()  # -> frames_wobj
# ---------- python_6: Python ----------
from compas.geometry import Frame
from compas.geometry import Point
from compas.geometry import Vector

#R1 calibration resulting frames
frames_wobj = {
'x1':Frame(Point(2.762768, 1.483214, 0.365833), Vector(-0.797, -0.574, -0.189), Vector(-0.506, 0.805, -0.311)),
'x2':Frame(Point(3.104401, 1.481151, 0.366987), Vector(-0.797, -0.574, -0.189), Vector(-0.506, 0.805, -0.311)),
'y1':Frame(Point(3.104434, 1.669760, 0.364630), Vector(-0.797, -0.574, -0.189), Vector(-0.506, 0.805, -0.311))
}

frames_wobj = [frames_wobj]
# ---------- end python_6 ----------
python_7 = GhPythonScript()  # -> frames_wobj
# ---------- python_7: Python ----------
from compas.geometry import Frame
from compas.geometry import Point
from compas.geometry import Vector

#R1 calibration resulting frames
frames_wobj = {
'x1': Frame(Point(2.117427, 0.237057, 0.695275), Vector(-0.831, 0.545, 0.109), Vector(0.377, 0.697, -0.610)),
'x2': Frame(Point(1.775055, 0.240101, 0.695195), Vector(-0.831, 0.545, 0.109), Vector(0.377, 0.697, -0.610)),
'y1': Frame(Point(1.774582, 0.051813, 0.691629), Vector(-0.831, 0.546, 0.109), Vector(0.377, 0.697, -0.610))
}

frames_wobj = [frames_wobj]
# ---------- end python_7 ----------
panel_2 = Panel(rob_num)
filter = StreamFilter(Gate=panel_2, Stream1=python_6, Stream2=python_5, Stream3=python_7)

info = Info()  # -> info
#   port info: Environment info.
# ---------- info: Python ----------
"""
Displays information about the active COMPAS environment.
"""
import compas_bootstrapper
from ghpythonlib.componentbase import executingcomponent as component

import compas


class CompasInfo(component):
    def RunScript(self):
        self.Message = 'COMPAS v{}'.format(compas.__version__)
        info = 'COMPAS Version: {}\nEnvironment: {}'
        return (info.format(compas.__version__, compas_bootstrapper.ENVIRONMENT_NAME))
# ---------- end info ----------
panel_3 = Panel(info)

# ----
# make the work object for R3 be its base (WOBJ0).
# 
# This is basically the process for finding where the base of R3 lives in space.
# 
# assuming wobj2 is "true", calculate where rob3 WOBJ0 needs to be so that you will calculate the wobj3 values when measuring same three points
# 
# wobj3_base_mm, is the transformation that is required to get a point in space into R3s coordinate frame
# This is the transformation necessary to get point into R3 wobj0 coordinate frame. This is also the base plane specified in the URDF for the robot. check that  this plane matches the R3 base frame (#27)
python_8 = GhPythonScript(wobj3=python_3.wobj3_m, wobj2=python.wobj2_m, p2=python_4.test_point)  # -> out, wobj3_base_mm, wobj3_new_out, p2_new_out
# ---------- python_8: Python ----------
from compas.geometry import Transformation
from compas_ghpython.artists import FrameArtist
from compas_ghpython.artists import PointArtist

from compas.geometry import Frame
from compas.geometry import Point
from compas.geometry import Vector
from compas.geometry import Transformation
from compas.geometry import Translation
from compas.geometry import translate_points

import copy

################
#ASSUMING R2 IS GROUND TRUTH, TRANSFORM REST TO MATCH

print "wobj to transform: ", wobj3

# location of wobj to transform (ROBOT 3)
x,y,z = wobj3.point
print "\n", x, y, z

#Scaling vectors (in dirn of wobj to transform)
vec_x = -wobj3.xaxis.unitized().scaled(x)
vec_y = -wobj3.yaxis.unitized().scaled(y)
vec_z = -wobj3.zaxis.unitized().scaled(z)
print "\n", vec_x, vec_y, vec_z

#New wobj transformed from the location of the correct wobj
p_wobj_new = copy.deepcopy(wobj2.point)

p_wobj_new.transform(Translation.from_vector(vec_x))
p_wobj_new.transform(Translation.from_vector(vec_y))
p_wobj_new.transform(Translation.from_vector(vec_z))
print "\n", p_wobj_new

wobj3_new = copy.deepcopy(wobj3)
wobj3_new.point = p_wobj_new
print "\n NEW WOBJ: ", wobj3_new

p2_in_wobj3_new = wobj3_new.to_local_coordinates(p2)
print "\nPoint in World to Send; ", p2_in_wobj3_new 

###################
wobj3_base_mm = copy.deepcopy(wobj3_new)
wobj3_base_mm.point  = wobj3_base_mm.point*1000
#wobj3_base_mm.xaxis = Vector(-1,0,0)
#wobj3_base_mm.yaxis = Vector(0,-1,0)
#print wobj3_base_mm.point.x
#wobj3_base_mm.point.x = wobj3_base_mm.point.x - 20
#print wobj3_base_mm.point.x
print wobj3_base_mm.axis_angle_vector
###################


############
artist = FrameArtist(wobj3_new)
wobj3_new_out = artist.draw()

artist = PointArtist(p2_in_wobj3_new)
p2_new_out = artist.draw()
################
# ---------- end python_8 ----------
data_3 = Data(python.wobj2_mm)
data_4 = Data(python_8.wobj3_base_mm)
data_5 = Data(python_2.wobj1_mm)
pln_4 = Plane(python_8.wobj3_new_out)
panel_4 = Panel(pln_4)
pt_2 = Point(python_8.p2_new_out)
panel_5 = Panel(rob_num)
filter_2 = StreamFilter(Gate=panel_5, Stream1=data_5, Stream2=data_3, Stream3=data_4)
data_6 = Data(filter_2)

# ----
# If axis is included then allow the robot to move along track
list_2 = ValueList({"Robot 1 - No Track, No Gripper": "robot1_notrack", "Robot 1 - No Track, Gripper": "robot1_notrack_gripper", "Robot 1 - Track, No Gripper": "robot1_track", "Robot 1 - Track, Gripper": "robot1_track_gripper"}, selected="Robot 1 - Track, Gripper")
list_3 = ValueList({"Robot 2 - No Track, No Gripper": "robot2_notrack", "Robot 2 - No Track, Gripper": "robot2_notrack_gripper", "Robot 2 - Track, No Gripper": "robot2_track", "Robot 2 - Track, Gripper": "robot2_track_gripper"}, selected="Robot 2 - Track, Gripper")
list_4 = ValueList({"Robot 3 - No Gripper": "robot3", "Robot 3 - Gripper": "robot3_gripper"}, selected="Robot 3 - Gripper")
data_7 = Data(list_2)
data_8 = Data(list_3)
data_9 = Data(list_4)
panel_6 = Panel(rob_num)
filter_3 = StreamFilter(Gate=panel_6, Stream1=data_7, Stream2=data_8, Stream3=data_9)
data_10 = Data(filter_3)

list_5 = ValueList({"platform": "ecl_platform", "wobj0", "acadia": "rob1_acadia_EBIT_01", "zerowaste": "ecl_rob1_zerowaste"}, selected="zerowaste")
list_6 = ValueList({"platform": "ecl_platform", "wobj0", "acadia": "rob2_acadia_EBIT_01", "zerowaste": "ecl_rob2_zerowaste"}, selected="zerowaste")
list_7 = ValueList({"world": "wobj0"}, selected="world")
panel_7 = Panel(rob_num)
filter_4 = StreamFilter(Gate=panel_7, Stream1=list_5, Stream2=list_6, Stream3=list_7)
data_11 = Data(filter_4)

list_8 = ValueList({"tool_gripper": "ecl_rob1_pneumatic_gripper", "tool_calibration": "ecl_rob1_calibration_tip"}, selected="tool_gripper")
list_9 = ValueList({"tool_gripper": "ecl_rob2_pneumatic_gripper", "tool_calibration": "ecl_rob2_calibration_tip"}, selected="tool_gripper")
list_10 = ValueList({"tool_gripper": "ecl_rob3_pneumatic_gripper", "tool_calibration": "ecl_rob3_calibration_tip"}, selected="tool_gripper")
panel_8 = Panel(rob_num)
filter_5 = StreamFilter(Gate=panel_8, Stream1=list_8, Stream2=list_9, Stream3=list_10)
data_12 = Data(filter_5)

list_11 = ValueList({"DO_1": "do_1"}, selected="DO_1")
list_12 = ValueList({"DO_2": "do_2"}, selected="DO_2")
list_13 = ValueList({"DO_1": "do_1"}, selected="DO_1")
panel_9 = Panel(rob_num)
filter_6 = StreamFilter(Gate=panel_9, Stream1=list_11, Stream2=list_12, Stream3=list_13)
data_13 = Data(filter_6)

# ----
# CALIBRATION STUFF (CAN DELETE PROBABLY)
panel_10 = Panel("/Users/edvard/Documents/github/zerowaste_robot/configs/presets")
# make sure you compose-up and are using the URDF with the correct tool and TCF location defined. Before defined tool frame manually (but this obsolete now)
list_14 = ValueList({"x1", "x2", "y1"}, selected="x1")
data_14 = Data(data_2)
python_9 = GhPythonScript(robot=data_14, path=panel_10, point=list_14, read_data=Toggle(True))  # -> config, config_scaled
# ---------- python_9: Python ----------
import os
import math
from compas_fab.utilities import read_data_from_json
from compas_fab.robots import Configuration


config = robot.zero_configuration()

if read_data:
    
    for rob_num in range(1,4):
        data = read_data_from_json(os.path.join(path, 'R{}/wobj_{}.json'.format(rob_num,point)))
        #data = read_data_from_json(os.path.join(path, 'R{}\wobj_{}.json'.format(rob_num,point)))
        
        c = Configuration.from_data(data)
        
        if rob_num in [1, 2]:  # only R1 and R2 have an external axis
            config["r{}_cart_joint".format(rob_num)] = c.get("r{}_cart_joint".format(rob_num))
    
        config["r{}_joint_1".format(rob_num)] = c.get("r{}_joint_1".format(rob_num))
        config["r{}_joint_2".format(rob_num)] = c.get("r{}_joint_2".format(rob_num))
        config["r{}_joint_3".format(rob_num)] = c.get("r{}_joint_3".format(rob_num))
        config["r{}_joint_4".format(rob_num)] = c.get("r{}_joint_4".format(rob_num))
        config["r{}_joint_5".format(rob_num)] = c.get("r{}_joint_5".format(rob_num))
        config["r{}_joint_6".format(rob_num)] = c.get("r{}_joint_6".format(rob_num))

print(config)

config_scaled = robot.zero_configuration()

for i in range(6):
    config_scaled['r1_joint_{}'.format(i + 1)] = math.radians(config['r1_joint_{}'.format(i + 1)])
    config_scaled['r2_joint_{}'.format(i + 1)] = math.radians(config['r2_joint_{}'.format(i + 1)])
    config_scaled['r3_joint_{}'.format(i + 1)] = math.radians(config['r3_joint_{}'.format(i + 1)])

#mm --> m
config_scaled['r1_cart_joint'] = config['r1_cart_joint'.format(i + 1)]/1000
config_scaled['r2_cart_joint'] = config['r2_cart_joint'.format(i + 1)]/1000

print(config_scaled)
# ---------- end python_9 ----------

panel_11 = Panel("R1 reachability")
python_10 = GhPythonScript()  # -> config
# ---------- python_10: Python ----------
#axis 1-6
config = [
180.0,
0.0,
0.0,
0.0,
90.0,
180.0]
# ---------- end python_10 ----------
python_11 = GhPythonScript()  # -> config
# ---------- python_11: Python ----------
#RETURN CONFIG (BEFORE PICKUP)

#axis 1-6 + track (mm)
config =[
90.0,
0.0,
0.0,
0.0,
90.0,
180,
100]
# ---------- end python_11 ----------
python_12 = GhPythonScript()  # -> config
# ---------- python_12: Python ----------
#RETURN CONFIG (BEFORE PICKUP)

#axis 1-6 + track
config = [
-90.0,
0.0,
0.0,
0.0,
90.0,
180,
100]
# ---------- end python_12 ----------

python_13 = GhPythonScript()  # -> frame_tool
# ---------- python_13: Python ----------
from compas.geometry import Frame

#calibration tip tcp measured in (at 0)
frame_tool = Frame([0.000473456,0.000169985,0.163856], [1, 0, 0], [0, 1, 0])
# ---------- end python_13 ----------
python_14 = GhPythonScript()  # -> frame_tool
# ---------- python_14: Python ----------
from compas.geometry import Frame

#calibration tip tcp measured in (at 0)
frame_tool = Frame([0.000583723,0.0000236933,0.0779321], [1, 0, 0], [0, 1, 0])
# ---------- end python_14 ----------
python_15 = GhPythonScript()  # -> frame_tool
# ---------- python_15: Python ----------
from compas.geometry import Frame

#calibration tip tcp measured in (at 0)
frame_tool = Frame([-0.000441033,-0.0000930574,0.164273], [1, 0, 0], [0, 1, 0])
# ---------- end python_15 ----------
panel_12 = Panel(rob_num)
filter_7 = StreamFilter(Gate=panel_12, Stream1=python_15, Stream2=python_13, Stream3=python_14)

# ----
# Robot 1
j1 = Slider(-90, range=-90..180)
j2 = Slider(45, range=-90..90)
j3 = Slider(-50, range=-180..75)
j4 = Slider(0, range=-400..400)
j5 = Slider(0, range=-125..120)
j6 = Slider(0, range=-400..400)
track = Slider(0, range=0..4)
data_15 = Data([j1, j2, j3, j4, j5, j6, track])

# ----
# Robot 2
j1_2 = Slider(-90, range=-90..180)
j2_2 = Slider(45, range=-90..90)
j3_2 = Slider(-50, range=-180..75)
j4_2 = Slider(0, range=-400..400)
j5_2 = Slider(0, range=-125..120)
j6_2 = Slider(0, range=-400..400)
track_2 = Slider(0, range=0..4)
data_16 = Data([j1_2, j2_2, j3_2, j4_2, j5_2, j6_2, track_2])

# ----
# Robot 3
j1_3 = Slider(0, range=-180..180)
j2_3 = Slider(45, range=-90..90)
j3_3 = Slider(-45, range=-180..75)
j4_3 = Slider(0, range=-400..400)
j5_3 = Slider(0, range=-125..120)
j6_3 = Slider(0, range=-400..400)
data_17 = Data([j1_3, j2_3, j3_3, j4_3, j5_3, j6_3])

pln_5 = Plane(Plane(origin=(2.830758264, 0.7907711057, 1.574029197), x=(-0.8478008778, 0.05372916565, -0.5275858682), y=(-0.5299622521, -0.0495742458, 0.846570969)))
pln_6 = Plane(Plane(origin=(3.49411558, 0.5093182549, 2.459433343), x=(-0.9991532505, -0.0407558839, 0.005633829045), y=(0.01978600028, -0.3559118853, 0.9343100364)))
pln_7 = Plane(Plane(origin=(3.464745234, 0.8139271423, 1.574750913), x=(-0.9995667025, -0.0260650601, -0.0136755185), y=(-0.01493104498, 0.04859926417, 0.9987067515)))
pln_8 = Plane(Plane(origin=(3.088899374, 0.8185809258, 1.574750913), x=(-0.9995667025, -0.0260650601, -0.0136755185), y=(-0.01493104498, 0.04859926417, 0.9987067515)))
pln_9 = Plane(Plane(origin=(3.252685579, 0.8254998021, 2.45943336), x=(-0.01927867394, -0.0363471434, -0.9991532505), y=(-0.9997110524, -0.01365012593, 0.01978600028)))
pln_10 = Plane(Plane(origin=(3.538419879, 1.093186541, 1.552214207), x=(-0.05208104147, -0.9538135202, 0.2958501883), y=(-0.03085350623, 0.2976476543, 0.9541770984)))
pln_11 = Plane(Plane(origin=(3.563552508, 0.9253929409, 1.558254571), x=(0.02478554511, 0.9995667025, 0.01587715081), y=(0.03790098241, 0.01493104498, -0.9991699452)))
pln_12 = Plane(Plane(origin=(3.446572766, 0.874257312, 1.558254571), x=(0.02478554511, 0.9995667025, 0.01587715081), y=(0.03790098241, 0.01493104498, -0.9991699452)))
pln_13 = Plane(Plane(origin=(3.093956145, 0.874257312, 1.558254571), x=(0.02478554511, 0.9995667025, 0.01587715081), y=(0.03790098241, 0.01493104498, -0.9991699452)))
# PRESET CONFIGS
pln_14 = Plane(Plane(origin=(3.471271053, 1.720744776, 2.305639229), x=(-0.9995667025, 0.01587715081, -0.02478554511), y=(-0.01493104498, -0.9991699452, -0.03790098241)))
number_slider = Slider(6, range=0..10)
pln_15 = Plane(Plane(origin=(3.083452379, 0.5062661854, 2.467282267), x=(-0.9995667025, -0.0171474899, -0.02392427124), y=(-0.01493104498, -0.4050769315, 0.914160677)))
pln_16 = Plane(Plane(origin=(3.464745234, 1.257934585, 1.574750894), x=(-0.9995667025, -0.02483118138, -0.01580568237), y=(-0.01493104498, -0.03502240197, 0.9992749848)))
pln_17 = Plane(Plane(origin=(3.128207301, 1.69982773, 2.505887084), x=(0.9969399724, 0.06808723637, -0.03840338033), y=(-0.06615943268, 0.9965846964, 0.04941530595)))
pln_18 = Plane(Plane(origin=(3.50993469, 1.159620876, 2.461715761), x=(0.02617450858, -0.01346485294, 0.9995667025), y=(-0.05665248556, 0.9982823046, 0.01493104498)))
filter_8 = StreamFilter(
    Gate=number_slider,
    Stream0=pln_5,
    Stream1=pln_6,
    Stream2=pln_15,
    Stream3=pln_7,
    Stream4=pln_9,
    Stream5=pln_9,
    Stream6=pln_9,
    Stream7=pln_16)
filter_9 = StreamFilter(
    Gate=number_slider,
    Stream0=pln_10,
    Stream1=pln_17,
    Stream2=pln_18,
    Stream3=pln_18,
    Stream4=pln_11,
    Stream5=pln_12,
    Stream6=pln_13,
    Stream7=pln_14)
panel_13 = Panel(rob_num)
filter_10 = StreamFilter(Gate=panel_13, Stream2=filter_8, Stream3=filter_9)

# ----
# Tool Attach
python_16 = GhPythonScript()  # -> config
# ---------- python_16: Python ----------
#RETURN CONFIG (BEFORE PICKUP)

#axis 1-6 + track (mm)
config = [
1.0, 
-20.0, 
67.0, 
3.0, 
-47.0, 
-92.0,
3900.0]
# ---------- end python_16 ----------
python_17 = GhPythonScript()  # -> config
# ---------- python_17: Python ----------
#RETURN CONFIG (BEFORE PICKUP)

#axis 1-6 + track
config = [
0.0, 
-20.0, 
67.0, 
3.0, 
-47.0, 
-93.0, 
0.0]
# ---------- end python_17 ----------
python_18 = GhPythonScript()  # -> config
# ---------- python_18: Python ----------
#axis 1-6
config = [
90.0,
0.0,
0.0,
0.0,
90,
180]
# ---------- end python_18 ----------
config = GhPythonScript(robot=data_2, r1=python_16, r2=python_17, r3=python_18)  # -> config, config_scaled; inputs r1: list, r2: list, r3: list
# ---------- config: Python ----------
import math

config = robot.zero_configuration()

for i in range(6):
    config['r1_joint_{}'.format(i + 1)] = r1[i]
    config['r2_joint_{}'.format(i + 1)] = r2[i]
    config['r3_joint_{}'.format(i + 1)] = r3[i]

#mm
config['r1_cart_joint'] = r1[6]
config['r2_cart_joint'] = r2[6]

print config

#for use in path planning
#radians and meters
config_scaled = robot.zero_configuration()

for i in range(6):
    config_scaled['r1_joint_{}'.format(i + 1)] = math.radians(r1[i])
    config_scaled['r2_joint_{}'.format(i + 1)] = math.radians(r2[i])
    config_scaled['r3_joint_{}'.format(i + 1)] = math.radians(r3[i])

#mm --> m
config_scaled['r1_cart_joint'] = r1[6]/1000
config_scaled['r2_cart_joint'] = r2[6]/1000

print config_scaled
# ---------- end config ----------

# ----
# Planning Preset
python_19 = GhPythonScript()  # -> config
# ---------- python_19: Python ----------
#axis 1-6
config = [
40.55,
16.21,
-13.89,
-0.0,
87.68,
130.55]
# ---------- end python_19 ----------
python_20 = GhPythonScript()  # -> config
# ---------- python_20: Python ----------
#ROBOT 1 CONFIG
#Start path planning from

#axis 1-6 + track (mm)
config = [
-37.57,
-3.24,
8.36,
0.19,
84.45,
230,
100]

#config = [
#-37.57,
#-3.24,
#8.36,
#0.19,
#84.45,
#230,
#100]
# ---------- end python_20 ----------
python_21 = GhPythonScript()  # -> config
# ---------- python_21: Python ----------
#ROBOT 1 CONFIG
#Start path planning from

#axis 1-6 + track
config = [
40.55,
16.21,
-13.89,
-0.0,
87.68,
130.55,
3900]

#axis 1-6 + track
#config = [40.55,16.21,-13.89,-0.0,87.68,130.55,3900]
# ---------- end python_21 ----------
config_2 = GhPythonScript(robot=data_2, r1=python_20, r2=python_21, r3=python_19)  # -> config, config_scaled; inputs r1: list, r2: list, r3: list; same code as config

# ----
# Return Preset
python_22 = GhPythonScript()  # -> config
# ---------- python_22: Python ----------
#RETURN CONFIG (BEFORE PICKUP)

#ROBOT1

#axis 1-6 + track (mm)
config = [
90,
0.0,
0.0,
0.0,
90,
180,
3800]


config = [
-90,
0.0,
0.0,
0.0,
90,
180,
3800]
# ---------- end python_22 ----------
python_23 = GhPythonScript()  # -> config
# ---------- python_23: Python ----------
#RETURN CONFIG (BEFORE PICKUP)

#ROBOT2

#axis 1-6 + track
config = [
90.0,
0.0,
0.0,
0.0,
90,
180,
100]
# ---------- end python_23 ----------
python_24 = GhPythonScript()  # -> config
# ---------- python_24: Python ----------
#axis 1-6

#ROBOT3

config = [
180.0,
0.0,
0.0,
0.0,
90,
180]
# ---------- end python_24 ----------
config_3 = GhPythonScript(robot=data_2, r1=python_12, r2=python_11, r3=python_10)  # -> config, config_scaled; inputs r1: list, r2: list, r3: list; same code as config

# ----
# move/rotate plane around on rhino canvas
pt_3 = Point(<point referenced from the Rhino model>)
crv = Curve(<curve referenced from the Rhino model>)
crv_2 = Curve(<curve referenced from the Rhino model>)
crv_3 = Curve(<curve referenced from the Rhino model>)
pt_4 = Point(<point referenced from the Rhino model>)
crv_4 = Curve(<curve referenced from the Rhino model>)
crv_5 = Curve(<curve referenced from the Rhino model>)
crv_6 = Curve(<curve referenced from the Rhino model>)
pt_5 = Point(<point referenced from the Rhino model>)
pl = ConstructPlane(Origin=pt_3, XAxis=crv, YAxis=crv_6)
pl_2 = ConstructPlane(Origin=pt_5, XAxis=crv_2, YAxis=crv_3)
pl_3 = ConstructPlane(Origin=pt_4, XAxis=crv_4, YAxis=crv_5)
panel_14 = Panel(rob_num)
filter_11 = StreamFilter(Gate=panel_14, Stream1=pl, Stream2=pl_2, Stream3=pl_3)

# ----
# tool TCF based on:
# actual values from controller
python_25 = GhPythonScript(point=list_14, frames_wobj=filter)  # -> out, tcf_draw, frame_tcf; inputs frames_wobj: list
# ---------- python_25: Python ----------
from compas_ghpython.artists import FrameArtist

frame_tcf = frames_wobj[0][point]
print frame_tcf

artist = FrameArtist(frame_tcf)
tcf_draw = artist.draw()
# ---------- end python_25 ----------
pln_19 = Plane(python_25.tcf_draw)

# ----
# tool TCF based on:
# FK using the URDF as defined
gripper_frames = GhPythonScript(robot=data_2, group=data_10, config=python_9.config_scaled)  # -> out, tcf_draw, frame_tcf
# ---------- gripper_frames: Python ----------
from compas_ghpython.artists import FrameArtist

frame_tcf = robot.forward_kinematics(config, group=group)
print frame_tcf

artist = FrameArtist(frame_tcf)
tcf_draw = artist.draw()
# ---------- end gripper_frames ----------
pln_20 = Plane(gripper_frames.tcf_draw)

pln_21 = Plane(filter_11)

# ----
# FORWARD KINEMATICS
config_4 = GhPythonScript(robot=data_2, r1=data_15, r2=data_16, r3=data_17)  # -> config; inputs r1: list, r2: list, r3: list
# ---------- config_4: Python ----------
import math

config = robot.zero_configuration()

for i in range(6):
    config['r1_joint_{}'.format(i + 1)] = math.radians(r1[i])
    config['r2_joint_{}'.format(i + 1)] = math.radians(r2[i])
    config['r3_joint_{}'.format(i + 1)] = math.radians(r3[i])

config['r1_cart_joint'] = r1[6]
config['r2_cart_joint'] = r2[6]

print config
# ---------- end config_4 ----------
gripper_frames_2 = GhPythonScript(robot=data_2, group=data_10, config=config_4)  # -> out, tcf_draw; same code as gripper_frames
pln_22 = Plane(gripper_frames_2.tcf_draw)
panel_15 = Panel(pln_22)

# ----
# INVERSE KINEMATICS
use_fk_as_start = BooleanToggle(True)
data_18 = Data(config_4)
filter_12 = StreamFilter(Gate=use_fk_as_start, Stream1=data_18)

# ----
# difference between TCF from URDF and CONTROLLER (mm)
python_26 = GhPythonScript(tcf_urdf=gripper_frames.frame_tcf, tcf_actual=python_25.frame_tcf)  # -> out, point_diff
# ---------- python_26: Python ----------
from compas.geometry import Transformation

diff = Transformation.from_frame_to_frame(tcf_urdf,tcf_actual)

point_diff = tcf_urdf.point - tcf_actual.point

#print diff
print 1000*point_diff.x, 1000*point_diff.y, 1000*point_diff.z
# ---------- end python_26 ----------
rec = DataRecorder(python_26.out, DataLimit=-10, RecordData=False)
data_19 = Data(rec)
panel_16 = Panel(data_19)
panel_17 = Panel(pln_20)
panel_18 = Panel(pln_19)

# ----
# this updated from cfab 0.19.1 to 0.27.0, added in the timeout functionality
panel_19 = Panel("0.2")
num = Number(panel_19)
data_20 = Data(data_2)
pln_23 = Plane(pln_21)
data_21 = Data(filter_12)
data_22 = Data(data_10)
ik = InverseKinematics(robot=data_20, plane=pln_23, start_configuration=data_21, group=data_22, timeout=num)  # -> configuration
#   port plane: The plane or frame to calculate the inverse kinematic for.
#   port start_configuration: If passed, calculates the inverse such that the joint positions differ the least from the start_configuration. Defaults to the zero configuration.
#   port group: The planning group used for calculation. Defaults to the robot's main planning group.
#   port configuration: The planning group's configuration.
# ---------- ik: Python ----------
"""
Calculate the robot's inverse kinematic for a given plane.

COMPAS FAB v0.27.0
"""
from compas_rhino.conversions import RhinoPlane
from ghpythonlib.componentbase import executingcomponent as component


class InverseKinematics(component):
    def RunScript(self, robot, plane, start_configuration, group, timeout):
        configuration = None
        if robot and robot.client and robot.client.is_connected and plane:
            frame = RhinoPlane.from_geometry(plane).to_compas_frame()
            configuration = robot.inverse_kinematics(frame, start_configuration, group, options={"timeout": timeout})
        return configuration
# ---------- end ik ----------

list_15 = ValueList({"Forward Kinematics": 0, "Inverse Kinematics": 1, "Preset Start Planning Config": 2, "Preset Return Config": 3, "Preset Tool Attach": 4, "Preset WOBJ Points": 5}, selected="Inverse Kinematics")
filter_13 = StreamFilter(
    Gate=list_15,
    Stream0=config_4,
    Stream1=ik,
    Stream2=config_2.config_scaled,
    Stream3=config_3.config_scaled,
    Stream4=config.config_scaled,
    Stream5=python_9.config_scaled)

data_23 = Data(data_2)
data_24 = Data(data_10)
robot_visualize = RobotVisualize(
    robot=data_23,
    group=data_24,
    configuration=filter_13,
    show_visual=Toggle(True),
    show_collision=Toggle(False),
    show_frames=Toggle(False),
    show_base_frame=Toggle(False),
    show_end_effector_frame=Toggle(True))  # -> visual, collision, attached_meshes, frames, base_frame, ee_frame; inputs attached_collision_meshes: list, show_visual: Boolean, show_collision: Boolean, show_frames: Boolean, show_base_frame: Boolean, show_end_effector_frame: Boolean, show_acm: Boolean
#   port group: The planning group used for end-effector and base visualization.
#   port configuration: The robot's full configuration.
#   port attached_collision_meshes: A list of attached collision meshes.
#   port show_visual: Whether or not to show the robot's visual meshes.
#   port show_collision: Whether or not to show the robot's collision meshes.
#   port show_frames: Whether or not to show the robot's joint frames.
#   port show_base_frame: Whether or not to show the robot's base frame.
#   port show_end_effector_frame: Whether or not to show the robot's end-effector frame.
#   port show_acm: Whether or not to show the attached collision meshes (if any).
#   port visual: The robot's visual Rhino meshes (if any).
#   port collision: The robot's collision Rhino meshes (if any).
#   port attached_meshes: The attached collision Rhino meshes (if any).
#   port frames: The robot's joint frames as Rhino planes (if any).
#   port base_frame: The robot's base frame as a Rhino plane (if any).
#   port ee_frame: The robot's end-effector frame as a Rhino plane (if any).
# ---------- robot_visualize: Python ----------
"""
Visualizes the robot.

COMPAS FAB v0.19.1
"""
from compas.geometry import Frame
from compas.geometry import Transformation
from compas_ghpython.artists import FrameArtist
from compas_ghpython.artists import MeshArtist
from ghpythonlib.componentbase import executingcomponent as component


class RobotVisualize(component):
    def RunScript(self, robot, group, configuration, attached_collision_meshes, show_visual, show_collision,
                  show_frames, show_base_frame, show_end_effector_frame, show_acm):

        visual = None
        collision = None
        attached_meshes = None
        frames = None
        base_frame = None
        ee_frame = None

        if robot:
            show_visual = True if show_visual is None else show_visual
            configuration = configuration or robot.zero_configuration()

            robot.update(configuration, visual=show_visual, collision=show_collision)
            compas_frames = robot.transformed_frames(configuration, group)

            if show_visual:
                visual = robot.artist.draw_visual()

            if show_collision:
                collision = robot.artist.draw_collision()

            if show_base_frame:
                base_compas_frame = compas_frames[0]
                artist = FrameArtist(base_compas_frame)
                base_frame = artist.draw()

            if show_end_effector_frame:
                ee_compas_frame = robot.forward_kinematics(configuration, group, options=dict(solver='model'))
                artist = FrameArtist(ee_compas_frame)
                ee_frame = artist.draw()

            if show_frames:
                frames = []
                for compas_frame in compas_frames[1:]:
                    artist = FrameArtist(compas_frame)
                    frame = artist.draw()
                    frames.append(frame)

            if show_acm:
                attached_meshes = []
                for acm in attached_collision_meshes:
                    frame = robot.forward_kinematics(configuration, options=dict(solver='model', link_name=acm.link_name))
                    T = Transformation.from_frame_to_frame(Frame.worldXY(), frame)
                    mesh = acm.collision_mesh.mesh.transformed(T)
                    attached_meshes.append(MeshArtist(mesh).draw())

        return (visual, collision, attached_meshes, frames, base_frame, ee_frame)
# ---------- end robot_visualize ----------

mesh_2 = Mesh(robot_visualize.visual)
panel_20 = Panel("""0
10""")
panel_21 = Panel("""1
2
3
4
5
6
7
8
9""")
panel_22 = Panel("""11
12
13
14
15
16
17
18
19""")
panel_23 = Panel("""20
21
22
23
24
25
26
27""")
item = ListItem(List=mesh_2, Index=panel_20, Wrap=True)
item_2 = ListItem(List=mesh_2, Index=panel_21, Wrap=True)
item_3 = ListItem(List=mesh_2, Index=panel_22, Wrap=True)
item_4 = ListItem(List=mesh_2, Index=panel_23, Wrap=True)
mesh_3 = Mesh(item)
mesh_4 = Mesh(item_2)
mesh_5 = Mesh(item_3)
mesh_6 = Mesh(item_4)

pln_24 = Plane(robot_visualize.base_frame)
pln_25 = Plane(robot_visualize.ee_frame)

deplane = DeconstructPlane(Plane=pln_25)  # -> Origin, XAxis, YAxis, ZAxis
rec_2 = DataRecorder(deplane.Origin, DataLimit=-10, RecordData=False)

# ----
# (#27) is R3 base frame specified in URDF
pln_26 = Plane(robot_visualize.frames)
item_5 = ListItem(List=pln_26, Index=Slider(27, range=0..37), Wrap=True)
pln_27 = Plane(item_5)

# ----
# Max Work Volume
pt_6 = Point([Point(3.697005397, -2.032034186, 2.11772112), Point(3.697005397, -2.003385064, 2.156023161), Point(3.697005397, -1.974071842, 2.193819373), Point(3.697005397, -1.944103449, 2.231098243), Point(3.697005397, -1.913489016, 2.267848413), Point(3.697005397, -1.882237865, 2.304058691)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])
pt_7 = Point([Point(3.697005397, 5.483414186, 2.13378112), Point(3.697005321, 5.454765064, 2.172083161), Point(3.697005243, 5.425451842, 2.209879373), Point(3.697005164, 5.395483449, 2.247158243), Point(3.697005082, 5.364869016, 2.283908413), Point(3.697004999, 5.333617865, 2.320118691)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])
pt_8 = Point([Point(5.959232904, 1.654519021, 2.421599543), Point(5.924717031, 1.654341382, 2.447188934), Point(5.889759858, 1.654179209, 2.472172203), Point(5.854372034, 1.654032551, 2.496541741), Point(5.818564337, 1.653901452, 2.520290123), Point(5.782347676, 1.653785953, 2.543410116)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])
shift = ShiftList(List=pt_6, Shift="87", Wrap=False)
shift_2 = ShiftList(List=pt_7, Shift="87", Wrap=False)
shift_3 = ShiftList(List=pt_8, Shift="36", Wrap=False)
shift_4 = ShiftList(List=shift, Shift=1, Wrap=False)
shift_5 = ShiftList(List=shift_2, Shift=1, Wrap=False)
shift_6 = ShiftList(List=shift_3, Shift=1, Wrap=False)
ln = Line(StartPoint=shift, EndPoint=shift_4)
ln_2 = Line(StartPoint=shift_2, EndPoint=shift_5)
ln_3 = Line(StartPoint=shift_3, EndPoint=shift_6)
join = JoinCurves(Curves=ln_2, Preserve=False)
join_2 = JoinCurves(Curves=ln, Preserve=False)
join_3 = JoinCurves(Curves=ln_3, Preserve=False)
reb = RebuildCurve(Curve=join_2, Degree="3", Count="3", Tangents=False)
reb_2 = RebuildCurve(Curve=join, Degree="3", Count="3", Tangents=False)
reb_3 = RebuildCurve(Curve=join_3, Degree="3", Count="3", Tangents=False)
crv_7 = Curve(reb_2)
crv_8 = Curve(reb)
extr = Extrude(Base=crv_7, Direction="{-3.9,0,0}")
dom = ConstructDomain(DomainStart="0", DomainEnd="2*Pi")
extr_2 = Extrude(Base=crv_8, Direction="{-3.9,0,0}")
crv_9 = Curve(reb_3)
crv_10 = Curve(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)
revsrf = Revolution(Curve=crv_9, Axis=crv_10, Domain=dom)
bbx = BrepBrep(BrepA=revsrf, BrepB=extr)  # -> Curves, Points
bbx_2 = BrepBrep(BrepA=revsrf, BrepB=extr_2)  # -> Curves, Points
bbx_3 = BrepBrep(BrepA=extr_2, BrepB=extr)  # -> Curves, Points
preview = CustomPreview(Geometry=revsrf, Material=ColourSwatch(SwatchColor=RGBA(131, 122, 250, 64)))
preview_2 = CustomPreview(Geometry=extr_2, Material=ColourSwatch(SwatchColor=RGBA(250, 122, 122, 64)))
preview_3 = CustomPreview(Geometry=extr, Material=ColourSwatch(SwatchColor=RGBA(250, 122, 122, 64)))

# ----
# plane --> frame updated from cfab 0.19.1 to 0.25.0
pln_28 = Plane(pln_25)
python_27 = GhPythonScript(p_send=pln_28)  # -> f_send; inputs p_send: list
# ---------- python_27: Python ----------
from compas.geometry import Frame
from compas.geometry import Point
from compas.geometry import Vector
from compas.geometry import Transformation
from compas_ghpython import draw_frame
from compas_rhino.geometry import RhinoPlane
import copy

f_send = []
for p in p_send:
    f = RhinoPlane.from_geometry(p).to_compas()
    
    
    p_origin = Point(p.Origin[0], p.Origin[1], p.Origin[2])*1000
    p_xaxis = Vector(p.XAxis[0], p.XAxis[1], p.XAxis[2])
    p_yaxis = Vector(p.YAxis[0], p.YAxis[1], p.YAxis[2])
    
    #this does not guarantee X and Y axis are in correct orientation
#    f_new = Frame.from_plane(copy.deepcopy(f))
#    f_new.point = f.point*1000

    f_new = Frame(p_origin, p_xaxis, p_yaxis)
    print f_new
    
    
    f_send.append(f_new)
    

print f_send
# ---------- end python_27 ----------
data_25 = Data(data_6)
python_28 = GhPythonScript(wobj=data_25, f_send=python_27)  # -> f_send_wobj, wobj_true, frame_sent; inputs f_send: list
# ---------- python_28: Python ----------
from compas.geometry import Frame
from compas_ghpython import draw_frame
from compas_rhino.geometry import RhinoPlane
import copy

from compas_ghpython.artists import FrameArtist

f_send_wobj = []
for f in f_send:
    f_new = copy.deepcopy(f)
#    f_new = f_new.transformed(T.inverse())
    f_send_wobj.append(wobj.to_local_coordinates(f_new))
    
print f_send_wobj

frame_draw = copy.deepcopy(f_send_wobj[0])
frame_draw.point = frame_draw.point/1000

artist = FrameArtist(frame_draw)
frame_sent = artist.draw()
# ---------- end python_28 ----------
pln_29 = Plane(python_28.frame_sent)

panel_24 = Panel(data_12)
panel_25 = Panel(data_11)
panel_26 = Panel(data_13)
panel_27 = Panel(rob_num)
data_26 = Data(data_2)
data_27 = Data(data)

# ----
# SEND ROBOT COMMANDS
# Must be connected to robot to run these commands
button = Button()
data_28 = Data(config.config)
python_29 = GhPythonScript(
    robot=data_26,
    ros=data_27,
    rob_num=panel_27,
    wobj=panel_25,
    tool=panel_24,
    io=panel_26,
    preset_config=data_28,
    send_to_preset=Button(),
    send_frames=python_28.f_send_wobj,
    send_to_frame=button,
    toggle_grippers=Button(),
    get_joints_config=Toggle(False))  # -> out, current_joints, current_config; inputs rob_num: Int32, send_frames: list
# ---------- python_29: Python ----------
import math

import compas_rrc as rrc
from compas.geometry import Frame
from compas.geometry import Plane

from compas_rhino.geometry import RhinoPlane

abb = rrc.AbbClient(ros, '/rob{}'.format(rob_num))

# Set Variables
speed = 100
abb.send(rrc.SetWorkObject(wobj))
abb.send(rrc.SetTool(tool))

if get_joints_config:
    current_config = robot.zero_configuration()
    current_joints, current_track = abb.send_and_wait(rrc.GetJoints(), timeout=3)

    if rob_num in [1, 2]:  # only R1 and R2 have an external axis
        current_config ["r{}_cart_joint".format(rob_num)] = current_track[0]/1000

    current_config ["r{}_joint_1".format(rob_num)] = math.radians(current_joints[0])
    current_config ["r{}_joint_2".format(rob_num)] = math.radians(current_joints[1])
    current_config ["r{}_joint_3".format(rob_num)] = math.radians(current_joints[2])
    current_config ["r{}_joint_4".format(rob_num)] = math.radians(current_joints[3])
    current_config ["r{}_joint_5".format(rob_num)] = math.radians(current_joints[4])
    current_config ["r{}_joint_6".format(rob_num)] = math.radians(current_joints[5])

    print current_config, current_joints
    

if send_to_preset:
    if rob_num == 1:
        axis = rrc.ExternalAxes(preset_config['r1_cart_joint'])
        joints = rrc.RobotJoints(
            preset_config['r1_joint_1'],
            preset_config['r1_joint_2'],
            preset_config['r1_joint_3'],
            preset_config['r1_joint_4'],
            preset_config['r1_joint_5'],
            preset_config['r1_joint_6'],
        )
    elif rob_num == 2:
        axis = rrc.ExternalAxes(preset_config['r2_cart_joint'])
        joints = rrc.RobotJoints(
            preset_config['r2_joint_1'],
            preset_config['r2_joint_2'],
            preset_config['r2_joint_3'],
            preset_config['r2_joint_4'],
            preset_config['r2_joint_5'],
            preset_config['r2_joint_6'],
        )
        
    done = abb.send(rrc.MoveToJoints(joints, axis, speed, rrc.Zone.FINE))
    print('Finished')


if send_to_frame:
    
    for f in send_frames:
        print f
        done = abb.send_and_wait(rrc.MoveToFrame(f, speed, rrc.Zone.FINE), timeout = 30)
        future = abb.send(rrc.Stop(feedback_level=rrc.FeedbackLevel.DONE))
    

if toggle_grippers:
    #open
    done = abb.send_and_wait(rrc.SetDigital(io,0),timeout = 5)
    
    done = abb.send_and_wait(rrc.WaitTime(2.0),timeout = 5)
#    done = abb.send_and_wait(rrc.Stop(),timeout = 5)
    
    #close
    done = abb.send_and_wait(rrc.SetDigital(io,1),timeout = 5)
# ---------- end python_29 ----------

panel_28 = Panel(python_29.current_joints)
panel_29 = Panel(python_29.out)
panel_30 = Panel(python_29.current_config)
