# Grasshopper definition IRB7600_visualize.ghx (Grasshopper 1.0.7)

# ----
# ROBOT CONNECT
panel = Panel("ros-79hh-s4fg.yaler.io")
ros = ROSConnect(connect=Toggle(True))  # -> ros_client, is_connected; inputs port: Int32, connect: Boolean
#   port ip: The ip address ROS. Defaults to 127.0.0.1.
#   port port: The port of ROS. Defaults to 9090.
#   port connect: If True, connects to ROS. If False, disconnects from ROS. Defaults to False.
#   port ros_client: The ROS client.
#   port is_connected: True if connection established.
# ---------- ros: Python ----------
"""
Connect or disconnect to ROS.

COMPAS FAB v0.19.1
"""
from ghpythonlib.componentbase import executingcomponent as component
from scriptcontext import sticky as st

from compas_fab.backends import RosClient
from compas_fab.ghpython.components import create_id


class ROSConnect(component):
    def RunScript(self, ip, port, connect):
        ros_client = None

        ip = ip or '127.0.0.1'
        port = port or 9090

        key = create_id(self, 'ros_client')
        ros_client = st.get(key, None)

        if ros_client:
            st[key].close()
        if connect:
            st[key] = RosClient(ip, port)
            st[key].run(5)

        ros_client = st.get(key, None)
        is_connected = ros_client.is_connected if ros_client else False
        return (ros_client, is_connected)
# ---------- end ros ----------
data = Data(ros.ros_client)
robot = ROSRobot(ros_client=data, load=Toggle(True))  # -> robot; inputs load: Boolean
#   port ros_client: The ROS client.
#   port load: If True, loads the robot from ROS. Defaults to False.
# ---------- robot: Python ----------
"""
Load robot directly from ROS.

COMPAS FAB v0.19.1
"""
from compas_ghpython.artists import RobotModelArtist
from ghpythonlib.componentbase import executingcomponent as component
from scriptcontext import sticky as st

from compas_fab.ghpython.components import create_id


class ROSRobot(component):
    def RunScript(self, ros_client, load):
        key = create_id(self, 'robot')

        if ros_client and ros_client.is_connected and load:
            # Load URDF from ROS
            st[key] = ros_client.load_robot(load_geometry=True, precision='12f')
            st[key].artist = RobotModelArtist(st[key].model)

        robot = st.get(key, None)
        if robot:  # client sometimes need to be restarted, without needing to reload geometry
            robot.client = ros_client
        return robot
# ---------- end robot ----------
data_2 = Data(robot)

# ----
# PLATFORM MESH
mesh = Mesh([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])

# ----
# IK Reach Grid (Very Slow)
number_slider = Slider(0, range=0..3)
pt = ConstructPoint(XCoordinate=Slider(1.6, range=0..3), YCoordinate=number_slider, ZCoordinate=Slider(0.9, range=0..3))
python = GhPythonScript(pnt=pt, r=Slider(0.1, range=0..3), draw=Toggle(False))  # -> t, sphere; inputs pnt: Point3d
# ---------- python: Python ----------
import math

from compas.geometry import Sphere
from compas.geometry import Point

from compas_ghpython.artists import SphereArtist


# 1. Define frames on a sphere
sphere = Sphere((0.4, 1, 0), 0.15)
sphere = Sphere(Point(pnt[0],pnt[1],pnt[2]), r)

print(sphere)

if draw:
    s = SphereArtist(sphere)
    t = s.draw()
# ---------- end python ----------
python_2 = GhPythonScript(sphere=python.sphere, robot=data_2, calc=Toggle(True), draw=Toggle(True))  # -> f_draw, configs_save, idx_soln, idx_no_soln
# ---------- python_2: Python ----------
import math
import json
import os
import timeit
import multiprocessing
import signal

from compas.geometry import Frame
from compas.geometry import Plane
from compas.geometry import Point

from compas_fab.robots import ReachabilityMap
from compas_fab.backends import InverseKinematicsError

from compas_ghpython.artists import FrameArtist


def points_on_sphere_generator(sphere):
    for theta_deg in range(90, 280, 60):
        for phi_deg in range(0, 90, 45):  # only half-sphere
            theta = math.radians(theta_deg)
            phi = math.radians(phi_deg)
            x = sphere.point.x + sphere.radius * math.cos(theta) * math.sin(phi)
            y = sphere.point.y + sphere.radius * math.sin(theta) * math.sin(phi)
            z = sphere.point.z + sphere.radius * math.cos(phi)
            point = Point(x, y, z)
            axis = sphere.point - point
            plane = Plane((x, y, z), axis)
            f = Frame.from_plane(plane)
            
            # for the old UR5 model from ROS Kinetic is zaxis the xaxis
            yield [Frame(f.point, f.xaxis, f.yaxis)]

def points_in_box(sphere):
    for i in [x/10.0 for x in range(0, 7, 5)]:
        for j in [x/10.0 for x in range(-16, 12, 10)]:
            for k in [x/10.0 for x in range(0, 10, 5)]:
                x = i + sphere.point.x
                y = j + sphere.point.y
                z = k + sphere.point.z
                
                point = Point(x,y,z)
                axis = sphere.point - point
                axis = (1,0,0)
                
                plane = Plane((x, y, z), axis)
                f = Frame.from_plane(plane)
                
                yield [Frame(f.point, f.xaxis, f.yaxis)]

#frame_gen = points_on_sphere_generator(sphere)
frame_gen = points_in_box(sphere)
gen_to_list = list(frame_gen)

print len(gen_to_list)

f_draw = []
if draw:
    for f in gen_to_list:
        artist = FrameArtist(f[0])
        f_draw.append(artist.draw())


#m = ReachabilityMap()
#m.calculate(points_on_sphere_generator(sphere), robot)
#m.to_json(os.path.join(m.data,"/Users/edvard/Documents/github/ECL_robotic_cell/setup/grasshopper", "reach_map_test_7600.json"))  

configs_save = []

idx_no_soln = []
idx_soln = []

def config_calc(frame):
    return robot.inverse_kinematics(frame, robot.zero_configuration(), robot.main_group_name)

def signal_handler(signum, frame):
    raise Exception("Timeout!")

if calc:
    for i,frames in enumerate(points_in_box(sphere)):
        print "\n", frames

        for frame in frames:
            try:
                #configurations = robot.iter_inverse_kinematics(frame, robot.zero_configuration(), group)
                #print list(configurations)
                
                configurations = config_calc(frame)
                #configurations = []
                idx_soln.append(i)
                
            except:
                print "no soln"
                configurations = robot.zero_configuration()
                idx_no_soln.append(i)
            
        configs_save.append(configurations)

print len(configs_save), "\n\n",
#print configs_save
print idx_soln, idx_no_soln
# ---------- end python_2 ----------
python_3 = GhPythonScript(configs_save=python_2.configs_save, save_data=Toggle(False))  # -> out, a; inputs configs_save: list
# ---------- python_3: Python ----------
import os
import json

path = "/Users/edvard/Documents/github/ECL_robotic_cell/setup/grasshopper"
name = "test"

print configs_save

configs_combined = {}
filepath = os.path.join(path, '{}.json'.format(name))

if save_data:
    for i,c in enumerate(configs_save):
        #c.to_json(os.path.join(path, '{}.json'.format(name), pretty=True)
        
        configs_combined['config_{}'.format(i)] = c.to_data()
        print configs_combined
        
    with open(filepath, "w") as f:
        json.dump(configs_combined, f, indent=4, sort_keys=True)
        
    f.close()
# ---------- end python_3 ----------
deplane = DeconstructPlane(Plane=python_2.f_draw)  # -> Origin, XAxis, YAxis, ZAxis
item = ListItem(List=deplane.Origin, Index=python_2.idx_soln, Wrap=True)
item_2 = ListItem(List=python_2.f_draw, Index=Slider(14, range=0..30), Wrap=True)
item_3 = ListItem(List=deplane.Origin, Index=python_2.idx_no_soln, Wrap=True)
sph = Sphere(Base=item, Radius="0.02")
sph_2 = Sphere(Base=item_3, Radius="0.02")
preview = CustomPreview(Geometry=sph, Material=ColourSwatch(SwatchColor=RGB(0, 60, 255)))
preview_2 = CustomPreview(Geometry=sph_2, Material=ColourSwatch(SwatchColor=RGB(255, 0, 0)))

# ----
# planning group, including gripper plans to TCP
list = ValueList({"IRB7600": "irb7600", "IRB7600 + gripper": "irb7600_gripper"}, selected="IRB7600 + gripper")
list_2 = ValueList({"platform": "ecl_platform", "world": "ecl_zero", "wobj_1": "rob1_acadia_EBIT_01", "wobj_2": "rob2_acadia_EBIT_01"}, selected="wobj_1")
rob_num = Number("1")
data_3 = Data(list)
data_4 = Data(list_2)

# ----
# Robot 1
j1 = Slider(180, range=-180..180)
j2 = Slider(90, range=-90..90)
j3 = Slider(-90, range=-180..75)
j5 = Slider(0, range=-125..120)
j6 = Slider(0, range=-400..400)
j4 = Slider(0, range=-400..400)
data_5 = Data([j1, j2, j3, j4, j5, j6])

# ----
# PRESET CONFIGS
# Planning Preset
python_4 = GhPythonScript()  # -> out, config
# ---------- python_4: Python ----------
#ROBOT 1 CONFIG
#Start path planning from

#axis 1-6 + track (mm)
config = [
-37.57,
-3.24,
8.36,
0.19,
84.45,
230,
100]

#config = [
#-37.57,
#-3.24,
#8.36,
#0.19,
#84.45,
#230,
#100]
# ---------- end python_4 ----------
config = GhPythonScript(robot=data_2, r1=python_4.config)  # -> config, config_scaled; inputs r1: list
# ---------- config: Python ----------
import math

config = robot.zero_configuration()

for i in range(6):
    config['joint_{}'.format(i + 1)] = r1[i]

print config

#for use in path planning
#radians and meters
config_scaled = robot.zero_configuration()

for i in range(6):
    config_scaled['joint_{}'.format(i + 1)] = math.radians(r1[i])

print config_scaled
# ---------- end config ----------

# ----
# Return Preset
python_5 = GhPythonScript()  # -> out, config
# ---------- python_5: Python ----------
#RETURN CONFIG (BEFORE PICKUP)

#axis 1-6 + track (mm)
config = [
-90.0,
0.0,
0.0,
0.0,
90,
180,
100]
# ---------- end python_5 ----------
config_2 = GhPythonScript(robot=data_2, r1=python_5.config)  # -> config, config_scaled; inputs r1: list; same code as config

# ----
# FORWARD KINEMATICS
config_3 = GhPythonScript(robot=data_2, r1=data_5)  # -> config; inputs r1: list
# ---------- config_3: Python ----------
import math

config = robot.zero_configuration()
print config

for i in range(6):
    config['joint_{}'.format(i + 1)] = math.radians(r1[i])

print config
# ---------- end config_3 ----------
gripper_frames = GhPythonScript(robot=data_2, group=data_3, config=config_3)  # -> out
# ---------- gripper_frames: Python ----------
print repr(robot.forward_kinematics(config, group=group))
# ---------- end gripper_frames ----------
panel_2 = Panel(gripper_frames)

# ----
# INVERSE KINEMATICS
panel_3 = Panel("move point around")
pt_2 = Point(Point(1.447377209, 0.5966176817, 1.205160833))
pl = ConstructPlane(Origin=pt_2, XAxis=Vector(1, 0, 0), YAxis=Vector(0, -1, 0))
use_fk_as_start = BooleanToggle(True)
data_6 = Data(config_3)
filter = StreamFilter(Gate=use_fk_as_start, Stream1=data_6)
pln = Plane(pl)
data_7 = Data(filter)
ik = InverseKinematics(robot=data_2, plane=pln, start_configuration=data_7, group=data_3)  # -> configuration
#   port plane: The plane or frame to calculate the inverse kinematic for.
#   port start_configuration: If passed, calculates the inverse such that the joint positions differ the least from the start_configuration. Defaults to the zero configuration.
#   port group: The planning group used for calculation. Defaults to the robot's main planning group.
#   port configuration: The planning group's configuration.
# ---------- ik: Python ----------
"""
Calculate the robot's inverse kinematic for a given plane.

COMPAS FAB v0.19.1
"""
from ghpythonlib.componentbase import executingcomponent as component

from compas_fab.ghpython.components import coerce_frame


class InverseKinematics(component):
    def RunScript(self, robot, plane, start_configuration, group):
        configuration = None
        if robot and robot.client and robot.client.is_connected and plane:
            frame = coerce_frame(plane)
            configuration = robot.inverse_kinematics(frame, start_configuration, group)
        if start_configuration:
            return start_configuration.merged(configuration)
        else:
            return configuration
# ---------- end ik ----------

# ----
# DISPLAY
list_3 = ValueList({"Forward Kinematics": 0, "Inverse Kinematics": 1, "Preset Start Planning Config": 2, "Preset Return Config": 3}, selected="Forward Kinematics")
filter_2 = StreamFilter(Gate=list_3, Stream0=config_3, Stream1=ik, Stream2=config.config_scaled, Stream3=config_2.config_scaled)
robot_visualize = RobotVisualize(robot=data_2, group=data_3, configuration=filter_2, show_end_effector_frame=Toggle(True))  # -> visual, collision, attached_meshes, frames, base_frame, ee_frame; inputs attached_collision_meshes: list, show_visual: Boolean, show_collision: Boolean, show_frames: Boolean, show_base_frame: Boolean, show_end_effector_frame: Boolean, show_acm: Boolean
#   port group: The planning group used for end-effector and base visualization.
#   port configuration: The robot's full configuration.
#   port attached_collision_meshes: A list of attached collision meshes.
#   port show_visual: Whether or not to show the robot's visual meshes.
#   port show_collision: Whether or not to show the robot's collision meshes.
#   port show_frames: Whether or not to show the robot's joint frames.
#   port show_base_frame: Whether or not to show the robot's base frame.
#   port show_end_effector_frame: Whether or not to show the robot's end-effector frame.
#   port show_acm: Whether or not to show the attached collision meshes (if any).
#   port visual: The robot's visual Rhino meshes (if any).
#   port collision: The robot's collision Rhino meshes (if any).
#   port attached_meshes: The attached collision Rhino meshes (if any).
#   port frames: The robot's joint frames as Rhino planes (if any).
#   port base_frame: The robot's base frame as a Rhino plane (if any).
#   port ee_frame: The robot's end-effector frame as a Rhino plane (if any).
# ---------- robot_visualize: Python ----------
"""
Visualizes the robot.

COMPAS FAB v0.19.1
"""
from compas.geometry import Frame
from compas.geometry import Transformation
from compas_ghpython.artists import FrameArtist
from compas_ghpython.artists import MeshArtist
from ghpythonlib.componentbase import executingcomponent as component


class RobotVisualize(component):
    def RunScript(self, robot, group, configuration, attached_collision_meshes, show_visual, show_collision,
                  show_frames, show_base_frame, show_end_effector_frame, show_acm):

        visual = None
        collision = None
        attached_meshes = None
        frames = None
        base_frame = None
        ee_frame = None

        if robot:
            show_visual = True if show_visual is None else show_visual
            configuration = configuration or robot.zero_configuration()

            robot.update(configuration, visual=show_visual, collision=show_collision)
            compas_frames = robot.transformed_frames(configuration, group)

            if show_visual:
                visual = robot.artist.draw_visual()

            if show_collision:
                collision = robot.artist.draw_collision()

            if show_base_frame:
                base_compas_frame = compas_frames[0]
                artist = FrameArtist(base_compas_frame)
                base_frame = artist.draw()

            if show_end_effector_frame:
                ee_compas_frame = robot.forward_kinematics(configuration, group, options=dict(solver='model'))
                artist = FrameArtist(ee_compas_frame)
                ee_frame = artist.draw()

            if show_frames:
                frames = []
                for compas_frame in compas_frames[1:]:
                    artist = FrameArtist(compas_frame)
                    frame = artist.draw()
                    frames.append(frame)

            if show_acm:
                attached_meshes = []
                for acm in attached_collision_meshes:
                    frame = robot.forward_kinematics(configuration, options=dict(solver='model', link_name=acm.link_name))
                    T = Transformation.from_frame_to_frame(Frame.worldXY(), frame)
                    mesh = acm.collision_mesh.mesh.transformed(T)
                    attached_meshes.append(MeshArtist(mesh).draw())

        return (visual, collision, attached_meshes, frames, base_frame, ee_frame)
# ---------- end robot_visualize ----------

deplane_2 = DeconstructPlane(Plane=robot_visualize.ee_frame)  # -> Origin, XAxis, YAxis, ZAxis
pt_3 = Point(deplane_2.Origin)
pt_4 = Point([Point(-1.920961756, 0, 1.934955808), Point(-1.920961756, 0, 1.934955808), Point(-1.920961756, 0, 1.934955808), Point(-1.920961756, 0, 1.934955808), Point(-1.920961756, 0, 1.934955808), Point(-1.920961756, 0, 1.934955808)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])
pt_5 = Point([Point(-2.981585418, -0.05204376706, 1.17035458), Point(-2.980223019, -0.1040716811, 1.17035458), Point(-2.977952815, -0.1560678939, 1.17035458), Point(-2.974775499, -0.2080165669, 1.17035458), Point(-2.970692036, -0.259901876, 1.17035458), Point(-2.965703672, -0.3117080165, 1.17035458)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])
rec = DataRecorder(pt_3, DataLimit=-10, RecordData=False)
