# Grasshopper definition bar_lab_visualize.ghx (Grasshopper 1.0.7)

panel = Panel("ros-79hh-s4fg.yaler.io")
ros = ROSConnect(connect=Toggle(True))  # -> ros_client, is_connected; inputs port: Int32, connect: Boolean
#   port ip: The ip address ROS. Defaults to 127.0.0.1.
#   port port: The port of ROS. Defaults to 9090.
#   port connect: If True, connects to ROS. If False, disconnects from ROS. Defaults to False.
#   port ros_client: The ROS client.
#   port is_connected: True if connection established.
# ---------- ros: Python ----------
"""
Connect or disconnect to ROS.

COMPAS FAB v0.19.1
"""
from ghpythonlib.componentbase import executingcomponent as component
from scriptcontext import sticky as st

from compas_fab.backends import RosClient
from compas_fab.ghpython.components import create_id


class ROSConnect(component):
    def RunScript(self, ip, port, connect):
        ros_client = None

        ip = ip or '127.0.0.1'
        port = port or 9090

        key = create_id(self, 'ros_client')
        ros_client = st.get(key, None)

        if ros_client:
            st[key].close()
        if connect:
            st[key] = RosClient(ip, port)
            st[key].run(5)

        ros_client = st.get(key, None)
        is_connected = ros_client.is_connected if ros_client else False
        return (ros_client, is_connected)
# ---------- end ros ----------
data = Data(ros.ros_client)
robot = ROSRobot(ros_client=data, load=Toggle(True))  # -> robot; inputs load: Boolean
#   port ros_client: The ROS client.
#   port load: If True, loads the robot from ROS. Defaults to False.
# ---------- robot: Python ----------
"""
Load robot directly from ROS.

COMPAS FAB v0.19.1
"""
from compas_ghpython.artists import RobotModelArtist
from ghpythonlib.componentbase import executingcomponent as component
from scriptcontext import sticky as st

from compas_fab.ghpython.components import create_id


class ROSRobot(component):
    def RunScript(self, ros_client, load):
        key = create_id(self, 'robot')

        if ros_client and ros_client.is_connected and load:
            # Load URDF from ROS
            st[key] = ros_client.load_robot(load_geometry=True, precision='12f')
            st[key].artist = RobotModelArtist(st[key].model)

        robot = st.get(key, None)
        if robot:  # client sometimes need to be restarted, without needing to reload geometry
            robot.client = ros_client
        return robot
# ---------- end robot ----------
data_2 = Data(robot)

list = ValueList({"Robot 1": 1, "Robot 2": 2, "Robot 3": 3}, selected="Robot 2")

python = GhPythonScript()  # -> wobj2_mm, wobj2_m, draw_wobj2_m
# ---------- python: Python ----------
from compas.geometry import Frame
from compas_ghpython.artists import FrameArtist

#THIS IS WOBJ FOR R2
p = [3107.65,1478.91,367.994]
wobj2_mm = Frame.from_quaternion([0.99999,-0.00305874,-0.00165978,-0.0029736], p)

p = [3.10765,1.47891,0.367994]
wobj2_m = Frame.from_quaternion([0.99999,-0.00305874,-0.00165978,-0.0029736], p)

artist = FrameArtist(wobj2_m)
draw_wobj2_m = artist.draw()
# ---------- end python ----------
python_2 = GhPythonScript()  # -> wobj1_mm, draw_wobj1_m
# ---------- python_2: Python ----------
from compas.geometry import Frame
from compas_ghpython.artists import FrameArtist

#THIS IS WOBJ FOR R1
p=[3103.33,1481.11,366.83]
wobj1_mm = Frame.from_quaternion([0.999976,-0.00604606,-0.00149283,-0.0029774],p)

p=[3.10333,1.48111,0.36683]
wobj1_m = Frame.from_quaternion([0.999976,-0.00604606,-0.00149283,-0.0029774],p)

artist = FrameArtist(wobj1_m)
draw_wobj1_m = artist.draw()
# ---------- end python_2 ----------
python_3 = GhPythonScript()  # -> wobj3_m, draw_wobj3_m
# ---------- python_3: Python ----------
from compas.geometry import Frame
from compas_ghpython.artists import FrameArtist

#THIS IS WOBJ FOR R3
p = [1776.27,240.085,695.195]
wobj3_mm = Frame.from_quaternion([0.00447221,-0.000156608,-0.00949994,0.999945], p)

p = [1.77627,0.240085,0.695195]
wobj3_m = Frame.from_quaternion([0.00447221,-0.000156608,-0.00949994,0.999945], p)

artist = FrameArtist(wobj3_m)
draw_wobj3_m = artist.draw()
# ---------- end python_3 ----------
pln = Plane(python_2.draw_wobj1_m)
pln_2 = Plane(python.draw_wobj2_m)
pln_3 = Plane(python_3.draw_wobj3_m)

python_4 = GhPythonScript(wobj2_m=python.wobj2_m)  # -> test_point, draw_testpoint
# ---------- python_4: Python ----------
from compas.geometry import Frame
from compas.geometry import Point
from compas.geometry import Vector

from compas_ghpython.artists import FrameArtist
from compas_ghpython.artists import PointArtist
from compas.geometry import Translation

p = wobj2_m.point

##################
t = Translation.from_vector(wobj2_m.xaxis)
test_point = Point.from_data(p).transformed(t)
print test_point
##################


artist = PointArtist(test_point)
draw_testpoint = artist.draw()
# ---------- end python_4 ----------
pt = Point(python_4.draw_testpoint)

# ----
# ECL PLATFORM MESH
mesh = Mesh([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])  # disabled

# ----
# ROBOT CONNECT
rob_num = Number(list)

info = Info()  # -> info
#   port info: Environment info.
# ---------- info: Python ----------
"""
Displays information about the active COMPAS environment.
"""
import compas_bootstrapper
from ghpythonlib.componentbase import executingcomponent as component

import compas


class CompasInfo(component):
    def RunScript(self):
        self.Message = 'COMPAS v{}'.format(compas.__version__)
        info = 'COMPAS Version: {}\nEnvironment: {}'
        return (info.format(compas.__version__, compas_bootstrapper.ENVIRONMENT_NAME))
# ---------- end info ----------
panel_2 = Panel(info)

# ----
# make the work object for R3 be its base (WOBJ0).
# 
# This is basically the process for finding where the base of R3 lives in space.
# 
# assuming wobj2 is "true", calculate where rob3 WOBJ0 needs to be so that you will calculate the wobj3 values when measuring same three points
# 
# wobj3_base_mm, is the transformation that is required to get a point in space into R3s coordinate frame
# This is the transformation necessary to get point into R3 wobj0 coordinate frame. This is also the base plane specified in the URDF for the robot. check that  this plane matches the R3 base frame (#27)
python_5 = GhPythonScript(wobj3=python_3.wobj3_m, wobj2=python.wobj2_m, p2=python_4.test_point)  # -> out, wobj3_base_mm, wobj3_new_out, p2_new_out
# ---------- python_5: Python ----------
from compas.geometry import Transformation
from compas_ghpython.artists import FrameArtist
from compas_ghpython.artists import PointArtist

from compas.geometry import Frame
from compas.geometry import Point
from compas.geometry import Vector
from compas.geometry import Transformation
from compas.geometry import Translation
from compas.geometry import translate_points

import copy

################
#ASSUMING R2 IS GROUND TRUTH, TRANSFORM REST TO MATCH

print "wobj to transform: ", wobj3

# location of wobj to transform (ROBOT 3)
x,y,z = wobj3.point
print "\n", x, y, z

#Scaling vectors (in dirn of wobj to transform)
vec_x = -wobj3.xaxis.unitized().scaled(x)
vec_y = -wobj3.yaxis.unitized().scaled(y)
vec_z = -wobj3.zaxis.unitized().scaled(z)
print "\n", vec_x, vec_y, vec_z

#New wobj transformed from the location of the correct wobj
p_wobj_new = copy.deepcopy(wobj2.point)

p_wobj_new.transform(Translation.from_vector(vec_x))
p_wobj_new.transform(Translation.from_vector(vec_y))
p_wobj_new.transform(Translation.from_vector(vec_z))
print "\n", p_wobj_new

wobj3_new = copy.deepcopy(wobj3)
wobj3_new.point = p_wobj_new
print "\n NEW WOBJ: ", wobj3_new

p2_in_wobj3_new = wobj3_new.to_local_coordinates(p2)
print "\nPoint in World to Send; ", p2_in_wobj3_new 

###################
wobj3_base_mm = copy.deepcopy(wobj3_new)
wobj3_base_mm.point  = wobj3_base_mm.point*1000
#wobj3_base_mm.xaxis = Vector(-1,0,0)
#wobj3_base_mm.yaxis = Vector(0,-1,0)
#print wobj3_base_mm.point.x
#wobj3_base_mm.point.x = wobj3_base_mm.point.x - 20
#print wobj3_base_mm.point.x
print wobj3_base_mm.axis_angle_vector
###################


############
artist = FrameArtist(wobj3_new)
wobj3_new_out = artist.draw()

artist = PointArtist(p2_in_wobj3_new)
p2_new_out = artist.draw()
################
# ---------- end python_5 ----------
data_3 = Data(python.wobj2_mm)
data_4 = Data(python_5.wobj3_base_mm)
data_5 = Data(python_2.wobj1_mm)
pln_4 = Plane(python_5.wobj3_new_out)
panel_3 = Panel(pln_4)
pt_2 = Point(python_5.p2_new_out)
panel_4 = Panel(rob_num)
filter = StreamFilter(Gate=panel_4, Stream1=data_5, Stream2=data_3, Stream3=data_4)
data_6 = Data(filter)

list_2 = ValueList({"Robot 2 - No Gantry": "robot2", "Robot 2 - XYZ Gantry": "robot2_XYZ", "Robot 2 - YZ Gantry": "robot2_YZ"}, selected="Robot 2 - XYZ Gantry")

# ----
# If axis is included then allow the robot to move along track
list_3 = ValueList({"Robot 1 - No Gantry": "robot1", "Robot 1 - XYZ Gantry": "robot1_XYZ", "Robot 1 - YZ Gantry": "robot1_YZ"}, selected="Robot 1 - XYZ Gantry")
data_7 = Data(list_3)
data_8 = Data(list_2)
panel_5 = Panel(rob_num)
filter_2 = StreamFilter(Gate=panel_5, Stream1=data_7, Stream2=data_8)
data_9 = Data(filter_2)

list_4 = ValueList({"platform": "ecl_platform", "wobj0", "acadia": "rob1_acadia_EBIT_01", "zerowaste": "ecl_rob1_zerowaste"}, selected="zerowaste")
list_5 = ValueList({"platform": "ecl_platform", "wobj0", "acadia": "rob2_acadia_EBIT_01", "zerowaste": "ecl_rob2_zerowaste"}, selected="zerowaste")
list_6 = ValueList({"world": "wobj0"}, selected="world")
panel_6 = Panel(rob_num)
filter_3 = StreamFilter(Gate=panel_6, Stream1=list_4, Stream2=list_5, Stream3=list_6)
data_10 = Data(filter_3)

list_7 = ValueList({"tool_gripper": "ecl_rob1_pneumatic_gripper", "tool_calibration": "ecl_rob1_calibration_tip"}, selected="tool_gripper")
list_8 = ValueList({"tool_gripper": "ecl_rob2_pneumatic_gripper", "tool_calibration": "ecl_rob2_calibration_tip"}, selected="tool_gripper")
list_9 = ValueList({"tool_gripper": "ecl_rob3_pneumatic_gripper", "tool_calibration": "ecl_rob3_calibration_tip"}, selected="tool_gripper")
panel_7 = Panel(rob_num)
filter_4 = StreamFilter(Gate=panel_7, Stream1=list_7, Stream2=list_8, Stream3=list_9)
data_11 = Data(filter_4)

list_10 = ValueList({"DO_1": "do_1"}, selected="DO_1")
list_11 = ValueList({"DO_2": "do_2"}, selected="DO_2")
list_12 = ValueList({"DO_1": "do_1"}, selected="DO_1")
panel_8 = Panel(rob_num)
filter_5 = StreamFilter(Gate=panel_8, Stream1=list_10, Stream2=list_11, Stream3=list_12)
data_12 = Data(filter_5)

pt_3 = ConstructPoint(XCoordinate=0, YCoordinate=0, ZCoordinate="0.252")
mesh_2 = Mesh([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])
pl = ConstructPlane(Origin=pt_3, XAxis=Vector(1, 0, 0), YAxis=Vector(0, 1, 0))
mjoin = MeshJoin(Meshes=mesh_2)
tool = AttachedTool(visual_mesh=mjoin, collision_mesh=mjoin, tcf_plane=pl, group=data_9)  # -> robot; inputs visual_mesh: Mesh, collision_mesh: Mesh
#   port visual_mesh: A visual mesh for the tool.
#   port collision_mesh: A collision mesh for the tool.
#   port tcf_plane: The frame of the tool in tool0 frame.
#   port group: The planning group to which the tool should be attached.
# ---------- tool: Python ----------
"""
Attach a tool to the robot.

COMPAS FAB v0.27.0
"""
from ghpythonlib.componentbase import executingcomponent as component
from compas_rhino.conversions import RhinoMesh
from compas_rhino.conversions import plane_to_compas_frame

from compas.geometry import Frame
from compas_fab.robots import Tool


class AttachToolComponent(component):
    def RunScript(self, robot, visual_mesh, collision_mesh, tcf_plane, group):
        if robot and robot.client and robot.client.is_connected and visual_mesh:
            if not collision_mesh:
                collision_mesh = visual_mesh

            c_visual_mesh = RhinoMesh.from_geometry(visual_mesh).to_compas()
            c_collision_mesh = RhinoMesh.from_geometry(collision_mesh).to_compas()

            if not tcf_plane:
                frame = Frame.worldXY()
            else:
                frame = plane_to_compas_frame(tcf_plane)
            tool = Tool(c_visual_mesh, frame, c_collision_mesh)

            robot.attach_tool(tool, group)

        return robot
# ---------- end tool ----------

# ----
# Planning Preset
python_6 = GhPythonScript()  # -> config
# ---------- python_6: Python ----------
#ROBOT 1 CONFIG
#Start path planning from

#mm and degrees

config = [
1000, #bridge1_joint_EA_X
2000, #robot1_joint_EA_Y
4000, #robot1_joint_EA_Z
0.0, #robot1_joint_1
10, #robot1_joint_2
20, #robot1_joint_3
0.0, #robot1_joint_4
0.0, #robot1_joint_5
0.0, #robot1_joint_6
]

print config
# ---------- end python_6 ----------
python_7 = GhPythonScript()  # -> config
# ---------- python_7: Python ----------
#ROBOT 2 CONFIG
#Start path planning from

#mm and degrees

config = [
14000, #bridge2_joint_EA_X
3500, #robot2_joint_EA_Y
3500, #robot2_joint_EA_Z
30, #robot2_joint_1
20, #robot2_joint_2
0.0, #robot2_joint_3
0.0, #robot2_joint_4
10, #robot2_joint_5
40, #robot2_joint_6
]

print config
# ---------- end python_7 ----------
config = GhPythonScript(robot=data_2, r1=python_6, r2=python_7)  # -> config, config_scaled; inputs r1: list, r2: list
# ---------- config: Python ----------
import math

config = robot.zero_configuration()

for i in range(3,9):
    config['robot1_joint_{}'.format(i - 2)] = r1[i]
    config['robot2_joint_{}'.format(i - 2)] = r2[i]

print config

#mm
config['bridge1_joint_EA_X'] = r1[0]
config['robot1_joint_EA_Y'] = r1[1]
config['robot1_joint_EA_Z'] = r1[2]
config['bridge2_joint_EA_X'] = r2[0]
config['robot2_joint_EA_Y'] = r2[1]
config['robot2_joint_EA_Z'] = r2[2]

print config

#for use in path planning
#radians and meters
config_scaled = robot.zero_configuration()

for i in range(3,9):
    config_scaled['robot1_joint_{}'.format(i - 2)] = math.radians(r1[i])
    config_scaled['robot2_joint_{}'.format(i - 2)] = math.radians(r2[i])

print config_scaled

#mm
config_scaled['bridge1_joint_EA_X'] = r1[0]/1000
config_scaled['robot1_joint_EA_Y'] = r1[1]/1000
config_scaled['robot1_joint_EA_Z'] = r1[2]/1000
config_scaled['bridge2_joint_EA_X'] = r2[0]/1000
config_scaled['robot2_joint_EA_Y'] = r2[1]/1000
config_scaled['robot2_joint_EA_Z'] = r2[2]/1000

print config_scaled
# ---------- end config ----------

# ----
# Return Preset
python_8 = GhPythonScript()  # -> config
# ---------- python_8: Python ----------
#ROBOT 1 CONFIG
#Start path planning from

#mm and degrees

config = [
1000, #bridge1_joint_EA_X
2000, #robot1_joint_EA_Y
4000, #robot1_joint_EA_Z
90, #robot1_joint_1
91, #robot1_joint_2
92, #robot1_joint_3
93, #robot1_joint_4
94, #robot1_joint_5
95, #robot1_joint_6
]

print config
# ---------- end python_8 ----------
python_9 = GhPythonScript()  # -> config
# ---------- python_9: Python ----------
#ROBOT 2 CONFIG
#Start path planning from

#mm and degrees

config = [
6000, #bridge2_joint_EA_X
3500, #robot2_joint_EA_Y
3500, #robot2_joint_EA_Z
81, #robot2_joint_1
82, #robot2_joint_2
83, #robot2_joint_3
84, #robot2_joint_4
85, #robot2_joint_5
86, #robot2_joint_6
]

print config
# ---------- end python_9 ----------
# Just palceholders for now...
config_2 = GhPythonScript(robot=data_2, r1=python_8, r2=python_9)  # -> config, config_scaled; inputs r1: list, r2: list; same code as config

# ----
# Tool Attach
python_10 = GhPythonScript()  # -> config; same code as python_8
python_11 = GhPythonScript()  # -> config; same code as python_9
config_3 = GhPythonScript(robot=data_2, r1=python_10, r2=python_11)  # -> config, config_scaled; inputs r1: list, r2: list; same code as config

# ----
# R1 Reachability
python_12 = GhPythonScript()  # -> config; same code as python_8
python_13 = GhPythonScript()  # -> config; same code as python_9
config_4 = GhPythonScript(robot=data_2, r1=python_12, r2=python_13)  # -> config, config_scaled; inputs r1: list, r2: list; same code as config

# ----
# random planes from zerowaste
pln_5 = Plane(Plane(origin=(3.252685579, 0.8254998021, 2.45943336), x=(-0.01927867394, -0.0363471434, -0.9991532505), y=(-0.9997110524, -0.01365012593, 0.01978600028)))
number_slider = Slider(6, range=0..10)
pln_6 = Plane(Plane(origin=(2.830758264, 0.7907711057, 1.574029197), x=(-0.8478008778, 0.05372916565, -0.5275858682), y=(-0.5299622521, -0.0495742458, 0.846570969)))
pln_7 = Plane(Plane(origin=(3.49411558, 0.5093182549, 2.459433343), x=(-0.9991532505, -0.0407558839, 0.005633829045), y=(0.01978600028, -0.3559118853, 0.9343100364)))
pln_8 = Plane(Plane(origin=(3.083452379, 0.5062661854, 2.467282267), x=(-0.9995667025, -0.0171474899, -0.02392427124), y=(-0.01493104498, -0.4050769315, 0.914160677)))
pln_9 = Plane(Plane(origin=(3.464745234, 0.8139271423, 1.574750913), x=(-0.9995667025, -0.0260650601, -0.0136755185), y=(-0.01493104498, 0.04859926417, 0.9987067515)))
pln_10 = Plane(Plane(origin=(3.088899374, 0.8185809258, 1.574750913), x=(-0.9995667025, -0.0260650601, -0.0136755185), y=(-0.01493104498, 0.04859926417, 0.9987067515)))
pln_11 = Plane(Plane(origin=(3.464745234, 1.257934585, 1.574750894), x=(-0.9995667025, -0.02483118138, -0.01580568237), y=(-0.01493104498, -0.03502240197, 0.9992749848)))
pln_12 = Plane(Plane(origin=(3.538419879, 1.093186541, 1.552214207), x=(-0.05208104147, -0.9538135202, 0.2958501883), y=(-0.03085350623, 0.2976476543, 0.9541770984)))
pln_13 = Plane(Plane(origin=(3.128207301, 1.69982773, 2.505887084), x=(0.9969399724, 0.06808723637, -0.03840338033), y=(-0.06615943268, 0.9965846964, 0.04941530595)))
pln_14 = Plane(Plane(origin=(3.50993469, 1.159620876, 2.461715761), x=(0.02617450858, -0.01346485294, 0.9995667025), y=(-0.05665248556, 0.9982823046, 0.01493104498)))
pln_15 = Plane(Plane(origin=(3.563552508, 0.9253929409, 1.558254571), x=(0.02478554511, 0.9995667025, 0.01587715081), y=(0.03790098241, 0.01493104498, -0.9991699452)))
pln_16 = Plane(Plane(origin=(3.446572766, 0.874257312, 1.558254571), x=(0.02478554511, 0.9995667025, 0.01587715081), y=(0.03790098241, 0.01493104498, -0.9991699452)))
pln_17 = Plane(Plane(origin=(3.093956145, 0.874257312, 1.558254571), x=(0.02478554511, 0.9995667025, 0.01587715081), y=(0.03790098241, 0.01493104498, -0.9991699452)))
# PRESET CONFIGS
pln_18 = Plane(Plane(origin=(3.471271053, 1.720744776, 2.305639229), x=(-0.9995667025, 0.01587715081, -0.02478554511), y=(-0.01493104498, -0.9991699452, -0.03790098241)))
filter_6 = StreamFilter(
    Gate=number_slider,
    Stream0=pln_6,
    Stream1=pln_7,
    Stream2=pln_8,
    Stream3=pln_9,
    Stream4=pln_5,
    Stream5=pln_5,
    Stream6=pln_5,
    Stream7=pln_11)
filter_7 = StreamFilter(
    Gate=number_slider,
    Stream0=pln_12,
    Stream1=pln_13,
    Stream2=pln_14,
    Stream3=pln_14,
    Stream4=pln_15,
    Stream5=pln_16,
    Stream6=pln_17,
    Stream7=pln_18)
panel_9 = Panel(rob_num)
filter_8 = StreamFilter(Gate=panel_9, Stream2=filter_6, Stream3=filter_7)

# ----
# planes linked to _ECL.3dm file
# move/rotate plane around on rhino canvas
pt_4 = Point(<point referenced from the Rhino model>)
crv = Curve(<curve referenced from the Rhino model>)
crv_2 = Curve(<curve referenced from the Rhino model>)
crv_3 = Curve(<curve referenced from the Rhino model>)
crv_4 = Curve(<curve referenced from the Rhino model>)
pt_5 = Point(<point referenced from the Rhino model>)
pl_2 = ConstructPlane(Origin=pt_4, XAxis=crv, YAxis=crv_2)
pl_3 = ConstructPlane(Origin=pt_5, XAxis=crv_3, YAxis=crv_4)
panel_10 = Panel(rob_num)
filter_9 = StreamFilter(Gate=panel_10, Stream1=pl_2, Stream2=pl_3)

zero_config = ZeroConfig(robot=data_2)  # -> config
#   port group: If assigned, it will return the zero configuration for the given group, otherwise a full zero configuration.
#   port config: The zero configuration.
# ---------- zero_config: Python ----------
"""
Get a zero configuration for a robot.

COMPAS FAB v0.27.0
"""
from ghpythonlib.componentbase import executingcomponent as component


class ConfigZero(component):
    def RunScript(self, robot, group):

        if robot:
            return robot.zero_configuration(group)

        return None
# ---------- end zero_config ----------

# ----
# FORWARD KINEMATICS
# BAR
robot11_joint_ea_y = Slider(0, range=0..7.3)
j4 = Slider(0, range=-300..300)
robot21_joint_ea_y = Slider(0, range=0..7.3)
robot21_joint_ea_z = Slider(2.956, range=2.956..4.706)
bridge1_joint_ea_x = Slider(0, range=0..13.005)
robot11_joint_ea_z = Slider(4.145, range=2.956..4.706)
j1 = Slider(3, range=-170..170)
j2 = Slider(0, range=-65..140)
j5 = Slider(0, range=-130..130)
j6 = Slider(0, range=-300..300)
bridge2_joint_ea_x = Slider(9.508, range=1.4..14.405)
j1_2 = Slider(0, range=-170..170)
j2_2 = Slider(0, range=-65..140)
j3 = Slider(0, range=-180..70)
j4_2 = Slider(0, range=-300..300)
j5_2 = Slider(0, range=-130..130)
j6_2 = Slider(0, range=-300..300)
j3_2 = Slider(0, range=-180..70)
merge = Merge(
    Data1=bridge1_joint_ea_x,
    Data2=robot11_joint_ea_y,
    Data3=robot11_joint_ea_z,
    Data4=j1,
    Data5=j2,
    Data6=j3_2,
    Data7=j4,
    Data8=j5,
    Data9=j6,
    Data10=bridge2_joint_ea_x,
    Data11=robot21_joint_ea_y,
    Data12=robot21_joint_ea_z,
    Data13=j1_2,
    Data14=j2_2,
    Data15=j3,
    Data16=j4_2,
    Data17=j5_2,
    Data18=j6_2)
config_5 = GhPythonScript(config=zero_config, r1=merge)  # -> config; inputs r1: list
# ---------- config_5: Python ----------
import math

print config

config['bridge1_joint_EA_X'] = r1[0]
config['robot1_joint_EA_Y'] = r1[1]
config['robot1_joint_EA_Z'] = r1[2]
config['robot1_joint_1'] = math.radians(r1[3])
config['robot1_joint_2'] = math.radians(r1[4])
config['robot1_joint_3'] = math.radians(r1[5])
config['robot1_joint_4'] = math.radians(r1[6])
config['robot1_joint_5'] = math.radians(r1[7])
config['robot1_joint_6'] = math.radians(r1[8])


config['bridge2_joint_EA_X'] = r1[9]
config['robot2_joint_EA_Y'] = r1[10]
config['robot2_joint_EA_Z'] = r1[11]
config['robot2_joint_1'] = math.radians(r1[12])
config['robot2_joint_2'] = math.radians(r1[13])
config['robot2_joint_3'] = math.radians(r1[14])
config['robot2_joint_4'] = math.radians(r1[15])
config['robot2_joint_5'] = math.radians(r1[16])
config['robot2_joint_6'] = math.radians(r1[17])

print config
# ---------- end config_5 ----------

# ----
# INVERSE KINEMATICS
use_fk_as_start = BooleanToggle(True)
pln_19 = Plane(filter_9)
data_13 = Data(config_5)
filter_10 = StreamFilter(Gate=use_fk_as_start, Stream1=data_13)

gripper_frames = GhPythonScript(robot=data_2, group=data_9, config=config_5)  # -> out, tcf_draw
# ---------- gripper_frames: Python ----------
from compas_ghpython.artists import FrameArtist

frame_tcf = robot.forward_kinematics(config, group=group)
print frame_tcf

artist = FrameArtist(frame_tcf)
tcf_draw = artist.draw()
# ---------- end gripper_frames ----------

# ----
# this updated from cfab 0.19.1 to 0.27.0, added in the timeout functionality
panel_11 = Panel("0.2")
num = Number(panel_11)
data_14 = Data(data_2)
pln_20 = Plane(pln_19)
data_15 = Data(filter_10)
data_16 = Data(data_9)
ik = InverseKinematics(robot=data_14, plane=pln_20, start_configuration=data_15, group=data_16, timeout=num)  # -> configuration
#   port plane: The plane or frame to calculate the inverse kinematic for.
#   port start_configuration: If passed, calculates the inverse such that the joint positions differ the least from the start_configuration. Defaults to the zero configuration.
#   port group: The planning group used for calculation. Defaults to the robot's main planning group.
#   port configuration: The planning group's configuration.
# ---------- ik: Python ----------
"""
Calculate the robot's inverse kinematic for a given plane.

COMPAS FAB v0.27.0
"""
from compas_rhino.conversions import RhinoPlane
from ghpythonlib.componentbase import executingcomponent as component


class InverseKinematics(component):
    def RunScript(self, robot, plane, start_configuration, group, timeout):
        configuration = None
        if robot and robot.client and robot.client.is_connected and plane:
            frame = RhinoPlane.from_geometry(plane).to_compas_frame()
            configuration = robot.inverse_kinematics(frame, start_configuration, group, options={"timeout": timeout})
        return configuration
# ---------- end ik ----------

pln_21 = Plane(gripper_frames.tcf_draw)
panel_12 = Panel(pln_21)

# ----
# PLAN TRAJECTORY AND VISUALIZE
mesh_3 = Mesh(<mesh referenced from the Rhino model>)
data_17 = Data(data_2)
scene = PlanningScene(robot=data_17)  # -> scene
#   port scene: A planning scene.
# ---------- scene: Python ----------
"""
Create a planning scene.

COMPAS FAB v0.26.0
"""
from ghpythonlib.componentbase import executingcomponent as component
from scriptcontext import sticky as st

from compas_fab.ghpython.components import create_id
from compas_fab.robots import PlanningScene


class PlanningSceneComponent(component):
    def RunScript(self, robot):
        key = create_id(self, 'planning_scene')
        if robot:
            st[key] = PlanningScene(robot)
        return st.get(key, None)
# ---------- end scene ----------
data_18 = Data(data_9)
data_19 = Data(pln_19)
constraints_from_plane = ConstraintsFromPlane(robot=data_17, plane=data_19, group=data_18)  # -> constraints
#   port plane: The plane or frame from which we create position and orientation constraints.
#   port group: The planning group for which we specify the constraint. Defaults to the robot's main planning group.
#   port tolerance_position: The allowed tolerance to the frame's position (defined in the robot's units). Defaults to 0.001
#   port tolerance_xaxis: The allowed tolerance of the frame's X-axis in degrees.
#   port tolerance_yaxis: The allowed tolerance of the frame's Y-axis in degrees.
#   port tolerance_zaxis: The allowed tolerance of the frame's Z-axis in degrees.
#   port constraints: A list containing a position and an orientation constraint.
# ---------- constraints_from_plane: Python ----------
"""
Create a position and an orientation constraint from a plane calculated for the group's end-effector link.

COMPAS FAB v0.26.0
"""
import math

from compas_rhino.conversions import RhinoPlane
from ghpythonlib.componentbase import executingcomponent as component


class ConstraintsFromPlane(component):
    def RunScript(self, robot, plane, group, tolerance_position, tolerance_xaxis, tolerance_yaxis, tolerance_zaxis):
        goal_constraints = None
        if robot and plane:
            tolerance_position = tolerance_position or 0.001
            tolerance_xaxis = tolerance_xaxis or 1.
            tolerance_yaxis = tolerance_yaxis or 1.
            tolerance_zaxis = tolerance_zaxis or 1.

            frame = RhinoPlane.from_geometry(plane).to_compas_frame()
            tolerances_axes = [math.radians(tolerance_xaxis), math.radians(tolerance_yaxis), math.radians(tolerance_zaxis)]
            goal_constraints = robot.constraints_from_frame(frame, tolerance_position, tolerances_axes, group)

        return goal_constraints
# ---------- end constraints_from_plane ----------
cm = CollisionMesh(scene=scene, mesh=mesh_3, identifier="test", add=Button(), remove=Button())  # -> ok; inputs mesh: Mesh, add: Boolean, remove: Boolean
#   port scene: The planning scene.
#   port mesh: A collision mesh.
#   port identifier: The identifier of the collision mesh.
#   port add: If True, adds the collision mesh to the planning scene.
#   port remove: If True, removes the collision mesh from the planning scene.
#   port ok: True if the operation was successfully performed.
# ---------- cm: Python ----------
"""
Add or remove a collision mesh from the planning scene.

COMPAS FAB v0.26.0
"""
from compas_rhino.geometry import RhinoMesh
from ghpythonlib.componentbase import executingcomponent as component

from compas_fab.robots import CollisionMesh


class CollisionMeshComponent(component):
    def RunScript(self, scene, M, name, add, remove):
        ok = False
        if scene and M and name:
            mesh = RhinoMesh.from_geometry(M).to_compas()
            collision_mesh = CollisionMesh(mesh, name)
            if add:
                scene.add_collision_mesh(collision_mesh)
                ok = True
            if remove:
                scene.remove_collision_mesh(name)
                ok = True
        return ok
# ---------- end cm ----------
data_20 = Data(config.config_scaled)
plan_motion = PlanMotion(robot=data_17, goal_constraints=constraints_from_plane, start_configuration=data_20, group=data_18, compute=Button())  # -> trajectory; inputs goal_constraints: list, attached_collision_meshes: list, path_constraints: list, compute: Boolean
#   port goal_constraints: The goal to be achieved, defined in a set of constraints. Constraints can be very specific, for example defining value domains for each joint, such that the goal configuration is included, or defining a volume in space, to which a specific robot link (e.g. the end-effector) is required to move to.
#   port start_configuration: The robot's full configuration, i.e. values for all configurable joints of the entire robot, at the starting position. Defaults to the all-zero configuration.
#   port group: The planning group used for calculation. Defaults to the robot's main planning group.
#   port attached_collision_meshes: A list of attached collision meshes to be included for planning.
#   port path_constraints: Optional constraints that can be imposed along the solution path. Note that path calculation won't work if the start_configuration violates these constraints. Defaults to None.
#   port planner_id: The name of the algorithm used for path planning. Defaults to 'RRTConnect'
#   port compute: If True, calculates a trajectory.
#   port trajectory: The calculated trajectory.
# ---------- plan_motion: Python ----------
"""
Calculate a motion path.

COMPAS FAB v0.26.0
"""
from ghpythonlib.componentbase import executingcomponent as component
from scriptcontext import sticky as st

from compas_fab.ghpython.components import create_id


class PlanMotion(component):
    def RunScript(self, robot, goal_constraints, start_configuration, group, attached_collision_meshes, path_constraints, planner_id, compute):

        key = create_id(self, 'trajectory')

        path_constraints = list(path_constraints) if path_constraints else None
        attached_collision_meshes = list(attached_collision_meshes) if attached_collision_meshes else None
        planner_id = str(planner_id) if planner_id else 'RRTConnect'

        if robot and robot.client and robot.client.is_connected and start_configuration and goal_constraints and compute:
            st[key] = robot.plan_motion(goal_constraints,
                                        start_configuration=start_configuration,
                                        group=group,
                                        options=dict(
                                            attached_collision_meshes=attached_collision_meshes,
                                            path_constraints=path_constraints,
                                            planner_id=planner_id,
                                        ))

        trajectory = st.get(key, None)
        return trajectory
# ---------- end plan_motion ----------
trajectory_visualize = TrajectoryVisualize(robot=data_17, group=data_18, trajectory=plan_motion)  # -> start_configuration, configurations, fraction, time, planes, P, V, A
#   port group: The planning group for which this trajectory was planned.
#   port trajectory: The calculated trajectory.
#   port start_configuration: The start configuration of the trajectory.
#   port configurations: The full configurations along the trajectory.
#   port fraction: Indicates the fraction of requested trajectory that was calculated, e.g. 1 means the full trajectory was found.
#   port time: The time which is needed to execute that trajectory at full speed.
#   port planes: The planes of the robot's end-effector.
#   port P: The positions along the trajectory
#   port V: The velocities along the trajectory
#   port A: The accelerations along the trajectory
# ---------- trajectory_visualize: Python ----------
"""
Visualizes a trajectory.

COMPAS FAB v0.26.0
"""
from compas_ghpython import draw_frame
from compas_ghpython import list_to_ghtree
from ghpythonlib.componentbase import executingcomponent as component


class TrajectoryVisualize(component):
    def RunScript(self, robot, group, trajectory):
        start_configuration = None
        configurations = []
        fraction = 0.
        time = 0.

        planes = []
        positions = []
        velocities = []
        accelerations = []

        if robot and trajectory:
            group = group or robot.main_group_name

            for c in trajectory.points:
                configurations.append(robot.merge_group_with_full_configuration(c, trajectory.start_configuration, group))
                frame = robot.forward_kinematics(c, group, options=dict(solver='model'))
                planes.append(draw_frame(frame))
                positions.append(c.positions)
                velocities.append(c.velocities)
                accelerations.append(c.accelerations)

            start_configuration = trajectory.start_configuration
            fraction = trajectory.fraction
            time = trajectory.time_from_start

        P = list_to_ghtree(list(zip(*positions)))
        V = list_to_ghtree(list(zip(*velocities)))
        A = list_to_ghtree(list(zip(*accelerations)))

        # return outputs if you have them; here I try it for you:
        return (start_configuration, configurations, fraction, time, planes, P, V, A)
# ---------- end trajectory_visualize ----------

list_13 = ValueList({"Forward Kinematics": 0, "Inverse Kinematics": 1, "Preset Start Planning Config": 2, "Preset Return Config": 3, "Preset Tool Attach": 4, "Preset Reachability": 5}, selected="Inverse Kinematics")
filter_11 = StreamFilter(
    Gate=list_13,
    Stream0=config_5,
    Stream1=ik,
    Stream2=config.config_scaled,
    Stream3=config_2.config_scaled,
    Stream4=config_3.config_scaled,
    Stream5=config_4.config_scaled)

zero_config_2 = ZeroConfig(robot=data_2)  # -> config; same code as zero_config
python_14 = GhPythonScript(partial=filter_11, full=zero_config_2)  # -> out, updated_config
# ---------- python_14: Python ----------
import compas_fab
from compas_fab.robots import Configuration


def update_robot_configuration(full_config, planning_config):
    """
    Update only the joints in full_config that exist in planning_config.

    Parameters:
    - full_config (Configuration): The full robot configuration.
    - planning_config (Configuration): The planning configuration with only some joints.

    Returns:
    - Configuration: The updated full configuration.
    """
    
    print full_config.joint_names, full_config.values
    
    joint_dict = dict(zip(full_config.joint_names, full_config.values()))  # Ensure calling methods
    
    print joint_dict

    for name, value in zip(planning_config.joint_names, planning_config.values()):  # Ensure calling methods
        if name in joint_dict:
            joint_dict[name] = value

    updated_config = Configuration.from_revolute_values(
        [joint_dict[name] for name in full_config.joint_names],
        full_config.joint_names
    )

    return updated_config
    
updated_config = update_robot_configuration(full, partial)
print(updated_config)
# ---------- end python_14 ----------

data_21 = Data(data_2)
data_22 = Data(data_9)
robot_visualize = RobotVisualize(
    robot=data_21,
    group=data_22,
    configuration=python_14.updated_config,
    show_visual=Toggle(True),
    show_collision=Toggle(False),
    show_frames=Toggle(False),
    show_base_frame=Toggle(False),
    show_end_effector_frame=Toggle(False))  # -> visual, collision, attached_meshes, frames, base_frame, ee_frame; inputs attached_collision_meshes: list, show_visual: Boolean, show_collision: Boolean, show_frames: Boolean, show_base_frame: Boolean, show_end_effector_frame: Boolean, show_acm: Boolean
#   port group: The planning group used for end-effector and base visualization.
#   port configuration: The robot's full configuration.
#   port attached_collision_meshes: A list of attached collision meshes.
#   port show_visual: Whether or not to show the robot's visual meshes.
#   port show_collision: Whether or not to show the robot's collision meshes.
#   port show_frames: Whether or not to show the robot's joint frames.
#   port show_base_frame: Whether or not to show the robot's base frame.
#   port show_end_effector_frame: Whether or not to show the robot's end-effector frame.
#   port show_acm: Whether or not to show the attached collision meshes (if any).
#   port visual: The robot's visual Rhino meshes (if any).
#   port collision: The robot's collision Rhino meshes (if any).
#   port attached_meshes: The attached collision Rhino meshes (if any).
#   port frames: The robot's joint frames as Rhino planes (if any).
#   port base_frame: The robot's base frame as a Rhino plane (if any).
#   port ee_frame: The robot's end-effector frame as a Rhino plane (if any).
# ---------- robot_visualize: Python ----------
"""
Visualizes the robot.

COMPAS FAB v0.19.1
"""
from compas.geometry import Frame
from compas.geometry import Transformation
from compas_ghpython.artists import FrameArtist
from compas_ghpython.artists import MeshArtist
from ghpythonlib.componentbase import executingcomponent as component


class RobotVisualize(component):
    def RunScript(self, robot, group, configuration, attached_collision_meshes, show_visual, show_collision,
                  show_frames, show_base_frame, show_end_effector_frame, show_acm):

        visual = None
        collision = None
        attached_meshes = None
        frames = None
        base_frame = None
        ee_frame = None

        if robot:
            show_visual = True if show_visual is None else show_visual
            configuration = configuration or robot.zero_configuration()

            robot.update(configuration, visual=show_visual, collision=show_collision)
            compas_frames = robot.transformed_frames(configuration, group)

            if show_visual:
                visual = robot.artist.draw_visual()

            if show_collision:
                collision = robot.artist.draw_collision()

            if show_base_frame:
                base_compas_frame = compas_frames[0]
                artist = FrameArtist(base_compas_frame)
                base_frame = artist.draw()

            if show_end_effector_frame:
                ee_compas_frame = robot.forward_kinematics(configuration, group, options=dict(solver='model'))
                artist = FrameArtist(ee_compas_frame)
                ee_frame = artist.draw()

            if show_frames:
                frames = []
                for compas_frame in compas_frames[1:]:
                    artist = FrameArtist(compas_frame)
                    frame = artist.draw()
                    frames.append(frame)

            if show_acm:
                attached_meshes = []
                for acm in attached_collision_meshes:
                    frame = robot.forward_kinematics(configuration, options=dict(solver='model', link_name=acm.link_name))
                    T = Transformation.from_frame_to_frame(Frame.worldXY(), frame)
                    mesh = acm.collision_mesh.mesh.transformed(T)
                    attached_meshes.append(MeshArtist(mesh).draw())

        return (visual, collision, attached_meshes, frames, base_frame, ee_frame)
# ---------- end robot_visualize ----------

mesh_4 = Mesh(robot_visualize.visual)  # disabled
panel_13 = Panel("""0
10""")  # disabled
panel_14 = Panel("""1
2
3
4
5
6
7
8
9""")  # disabled
panel_15 = Panel("""11
12
13
14
15
16
17
18
19""")  # disabled
panel_16 = Panel("""20
21
22
23
24
25
26
27""")  # disabled
item = ListItem(List=mesh_4, Index=panel_13, Wrap=True)  # disabled
item_2 = ListItem(List=mesh_4, Index=panel_14, Wrap=True)  # disabled
item_3 = ListItem(List=mesh_4, Index=panel_15, Wrap=True)  # disabled
item_4 = ListItem(List=mesh_4, Index=panel_16, Wrap=True)  # disabled
mesh_5 = Mesh(item)  # disabled
mesh_6 = Mesh(item_2)  # disabled
mesh_7 = Mesh(item_3)  # disabled
mesh_8 = Mesh(item_4)  # disabled

item_5 = ListItem(List=trajectory_visualize.configurations, Index=Slider(88, range=0..100), Wrap=True)
data_23 = Data(data_17)
data_24 = Data(data_18)
robot_visualize_2 = RobotVisualize(
    robot=data_23,
    group=data_24,
    configuration=item_5,
    show_visual=Toggle(True),
    show_collision=Toggle(False),
    show_frames=Toggle(False),
    show_base_frame=Toggle(False),
    show_end_effector_frame=Toggle(True))  # -> visual, collision, attached_meshes, frames, base_frame, ee_frame; inputs attached_collision_meshes: list, show_visual: Boolean, show_collision: Boolean, show_frames: Boolean, show_base_frame: Boolean, show_end_effector_frame: Boolean, show_acm: Boolean; same code as robot_visualize

# ----
# if doing "no track" planning group, the visualizer will show the robot at the 0-track position (since no track value in the group config)
pln_22 = Plane(robot_visualize.base_frame)
pln_23 = Plane(robot_visualize.ee_frame)

# ----
# (#27) is R3 base frame specified in URDF
pln_24 = Plane(robot_visualize.frames)
item_6 = ListItem(List=pln_24, Index=Slider(12, range=0..37), Wrap=True)
pln_25 = Plane(item_6)

robot_visualize_3 = RobotVisualize(
    robot=data_17,
    group=data_18,
    configuration=trajectory_visualize.configurations,
    show_visual=Toggle(False),
    show_collision=Toggle(False),
    show_frames=Toggle(False),
    show_base_frame=Toggle(False),
    show_end_effector_frame=Toggle(True))  # -> visual, collision, attached_meshes, frames, base_frame, ee_frame; inputs attached_collision_meshes: list, show_visual: Boolean, show_collision: Boolean, show_frames: Boolean, show_base_frame: Boolean, show_end_effector_frame: Boolean, show_acm: Boolean; same code as robot_visualize

panel_17 = Panel(pln_24)

# ----
# plane --> frame updated from cfab 0.19.1 to 0.25.0
pln_26 = Plane(pln_23)
python_15 = GhPythonScript(p_send=pln_26)  # -> f_send; inputs p_send: list
# ---------- python_15: Python ----------
from compas.geometry import Frame
from compas.geometry import Point
from compas.geometry import Vector
from compas.geometry import Transformation
from compas_ghpython import draw_frame
from compas_rhino.geometry import RhinoPlane
import copy

f_send = []
for p in p_send:
    f = RhinoPlane.from_geometry(p).to_compas()
    
    
    p_origin = Point(p.Origin[0], p.Origin[1], p.Origin[2])*1000
    p_xaxis = Vector(p.XAxis[0], p.XAxis[1], p.XAxis[2])
    p_yaxis = Vector(p.YAxis[0], p.YAxis[1], p.YAxis[2])
    
    #this does not guarantee X and Y axis are in correct orientation
#    f_new = Frame.from_plane(copy.deepcopy(f))
#    f_new.point = f.point*1000

    f_new = Frame(p_origin, p_xaxis, p_yaxis)
    print f_new
    
    
    f_send.append(f_new)
    

print f_send
# ---------- end python_15 ----------
data_25 = Data(data_6)
python_16 = GhPythonScript(wobj=data_25, f_send=python_15)  # -> f_send_wobj, wobj_true, frame_sent; inputs f_send: list
# ---------- python_16: Python ----------
from compas.geometry import Frame
from compas_ghpython import draw_frame
from compas_rhino.geometry import RhinoPlane
import copy

from compas_ghpython.artists import FrameArtist

f_send_wobj = []
for f in f_send:
    f_new = copy.deepcopy(f)
#    f_new = f_new.transformed(T.inverse())
    f_send_wobj.append(wobj.to_local_coordinates(f_new))
    
print f_send_wobj

frame_draw = copy.deepcopy(f_send_wobj[0])
frame_draw.point = frame_draw.point/1000

artist = FrameArtist(frame_draw)
frame_sent = artist.draw()
# ---------- end python_16 ----------
pln_27 = Plane(python_16.frame_sent)

panel_18 = Panel(data_11)
panel_19 = Panel(data_10)
panel_20 = Panel(data_12)
panel_21 = Panel(rob_num)
data_26 = Data(data_2)
data_27 = Data(data)

# ----
# SEND ROBOT COMMANDS
# Must be connected to robot to run these commands
button = Button()
data_28 = Data()
python_17 = GhPythonScript(
    robot=data_26,
    ros=data_27,
    rob_num=panel_21,
    wobj=panel_19,
    tool=panel_18,
    io=panel_20,
    preset_config=data_28,
    send_to_preset=Button(),
    send_frames=python_16.f_send_wobj,
    send_to_frame=button,
    toggle_grippers=Button(),
    get_joints_config=Toggle(False))  # -> out, current_joints, current_config; inputs rob_num: Int32, send_frames: list
# ---------- python_17: Python ----------
import math

import compas_rrc as rrc
from compas.geometry import Frame
from compas.geometry import Plane

from compas_rhino.geometry import RhinoPlane

abb = rrc.AbbClient(ros, '/rob{}'.format(rob_num))

# Set Variables
speed = 100
abb.send(rrc.SetWorkObject(wobj))
abb.send(rrc.SetTool(tool))

if get_joints_config:
    current_config = robot.zero_configuration()
    current_joints, current_track = abb.send_and_wait(rrc.GetJoints(), timeout=3)

    if rob_num in [1, 2]:  # only R1 and R2 have an external axis
        current_config ["r{}_cart_joint".format(rob_num)] = current_track[0]/1000

    current_config ["r{}_joint_1".format(rob_num)] = math.radians(current_joints[0])
    current_config ["r{}_joint_2".format(rob_num)] = math.radians(current_joints[1])
    current_config ["r{}_joint_3".format(rob_num)] = math.radians(current_joints[2])
    current_config ["r{}_joint_4".format(rob_num)] = math.radians(current_joints[3])
    current_config ["r{}_joint_5".format(rob_num)] = math.radians(current_joints[4])
    current_config ["r{}_joint_6".format(rob_num)] = math.radians(current_joints[5])

    print current_config, current_joints
    

if send_to_preset:
    if rob_num == 1:
        axis = rrc.ExternalAxes(preset_config['r1_cart_joint'])
        joints = rrc.RobotJoints(
            preset_config['r1_joint_1'],
            preset_config['r1_joint_2'],
            preset_config['r1_joint_3'],
            preset_config['r1_joint_4'],
            preset_config['r1_joint_5'],
            preset_config['r1_joint_6'],
        )
    elif rob_num == 2:
        axis = rrc.ExternalAxes(preset_config['r2_cart_joint'])
        joints = rrc.RobotJoints(
            preset_config['r2_joint_1'],
            preset_config['r2_joint_2'],
            preset_config['r2_joint_3'],
            preset_config['r2_joint_4'],
            preset_config['r2_joint_5'],
            preset_config['r2_joint_6'],
        )
        
    done = abb.send(rrc.MoveToJoints(joints, axis, speed, rrc.Zone.FINE))
    print('Finished')


if send_to_frame:
    
    for f in send_frames:
        print f
        done = abb.send_and_wait(rrc.MoveToFrame(f, speed, rrc.Zone.FINE), timeout = 30)
        future = abb.send(rrc.Stop(feedback_level=rrc.FeedbackLevel.DONE))
    

if toggle_grippers:
    #open
    done = abb.send_and_wait(rrc.SetDigital(io,0),timeout = 5)
    
    done = abb.send_and_wait(rrc.WaitTime(2.0),timeout = 5)
#    done = abb.send_and_wait(rrc.Stop(),timeout = 5)
    
    #close
    done = abb.send_and_wait(rrc.SetDigital(io,1),timeout = 5)
# ---------- end python_17 ----------

panel_22 = Panel(python_17.current_joints)
panel_23 = Panel(python_17.out)
panel_24 = Panel(python_17.current_config)
